# Grasshopper definition MT26_Versie the1(J-series 1.7)_VarendeConditie.gh (Grasshopper 1.0.7)

# ---- group: main particulars (L, B, T, D)
height_waterline_from_keel_true_or_deck = BooleanToggle(True)
waterline_m = Slider(6.5, range=0.1..30)
# The Simple Hull Generator for MT1458
# TU DELFT  in coorperation with Rhinocentre.nl
# DISCLAIMER
# Version 2.92 (26 may 2020)
# This grasshopper script is developed by Rhinocentre
# and the Technical Univercity Delft 3ME.
# 
# 
# This rapid ship hull modeling script is open
# source for anyone with good intentions.
# You are invited to share your developments.
# 
# The module Holtrop and Mennen is written in GH-Python by Jelle Woudstra
# 
# b.goris@tudelft.nl
# or bas@rhinocentre.nl
# or gerard@rhinocentre.nl
# INPUT
length_m = Slider(170, range=70..190)
breadth_boa_m = Slider(39.4, range=20..40)
depth_doa_m = Slider(19, range=10..25)

# ---- group: Heel and trim settings (only valid for angles <7 degrees)
trim_deg = Slider(0, range=-7..7)
heel_deg = Slider(0, range=-7..7)
rad = Radians(Degrees=heel_deg)
rad_2 = Radians(Degrees=trim_deg)

# ---- group: Stern manipulation
lpp_l0_85h = Slider(0.94, range=0.94..0.98)
input_stern_curve = Curve(<curve referenced from the Rhino model>)
length_aft_shoulder = Slider(10, range=10..90)

# ---- group: Scaling
toggle_scale_large_model_scale_1_270 = BooleanToggle(False)
scale_1_270_fixed = Integer(270)

# ---- group: Midship manipulation
midshiplength_of_lpp = Slider(50, range=5..70)
bilge_radius_m = Slider(11, range=0.4..15)
paralel_midship_combinations = Slider(0, range=0..2)
location_of_midship_of_lpp = Slider(30, range=30..70)

# ---- group: Bow manipulation
length_fwd_shoulder = Slider(10, range=10..90)
location_of_bow_intermediate_curve = Slider(25, range=25..95)
bow_tangency_shear_angle_deg = Slider(4, range=1..70)
input_bow_intermediate_curve = Curve(<curve referenced from the Rhino model>)
input_bow_cl_curve = Curve(<curve referenced from the Rhino model>)

# ---- group: Water Ballast Tank
fillingheight_of_tank_in_of_dm = Slider(40, range=0..100)
position_of_tank_bhd_in_of_loa = Slider(78, range=0..99)

# ---- group: Data wrt longitudinal bending
toggle_data_for_longitudinal_bending = BooleanToggle(True)
mean_shell_thickness_mm = Slider(1, range=0..100)

# ---- group: Miscellanious
toggle_volume_related_output = BooleanToggle(True)
toggle_cross_area_curves = BooleanToggle(True)
flip_loft_surface = Slider(0, range=0..1)
x_division_method = Slider(1, range=1..2)
plate_thickness_scale_model_mm_fixed = Number(0)
reference_rectangle_bxd = Curve(<curve referenced from the Rhino model>)

# ---- group: Input
# Resistance prediction by Holtrop & Mennen
toggle_holtrop_mennen_prediction = BooleanToggle(True)
method_selection_half_entrance_angle_ie = Slider(1, range=1..3)
entrance_angle_factor_of_bwl = Slider(45, range=0..50)
maximum_speed_for_resistance_table_kn = Slider(19, range=7..40)
design_speed_kn = Slider(19, range=6..30)
steps_per_knot_kn = Slider(2, range=1..2, expression="if(x=1,1,10)")
afterbody_form_coefficient_cstern = Slider(-25, range=-25..10)
method_selection_wet_shell_area = Slider(1, range=1..2)
eval = Evaluate(F="if(x=1,\"S_wet from Rhino model\",\"S_Wet HM regressive approach\")", x=method_selection_wet_shell_area)
panel = Panel(eval)
eval_2 = Evaluate(
    F="if(x=1,\"IE regressive approach 1984\",if(x=2,\"IE regressive approach 1978\", \"IE from Rhino model\"))",
    x=method_selection_half_entrance_angle_ie)
panel_2 = Panel(eval_2)

# ----
dimension_line_size = Slider(10, range=1..10)
tekst_size_m = Slider(1.5, range=1..10, expression="x")
output_dimension = ValueList({"mm": 1, "m": 1000}, selected="m")

# ----
# LINES PLAN
waterlines = Slider(5, range=1..10)
ordinates = Slider(12, range=2..80)
buttocks = Slider(5, range=1..10)

panel_3 = Panel(plate_thickness_scale_model_mm_fixed)
sift = SiftPattern(List=scale_1_270_fixed, SiftPattern=toggle_scale_large_model_scale_1_270)  # -> Output0, Output1
sift_2 = SiftPattern(List=1, SiftPattern=toggle_scale_large_model_scale_1_270)  # -> Output0, Output1

# ---- group: Check if the first three points of the bow curve are on Z=0
cp = ControlPoints(Curve=input_bow_cl_curve)  # -> Points, Weights, Knots
item = ListItem(List=cp.Points, Index=0, Wrap=True)  # -> Item, Item1, Item2
pt2num = PointsToNumbers(Points=flatten([item.Item, item.Item1, item.Item2]), Mask=11)  # -> expr("round(x,3)", Numbers)
equals = Equality(FirstNumber=pt2num, SecondNumber=0)  # -> Equality, Inequality
ma = MassAddition(Input=flatten(equals.Inequality))  # -> Result, PartialResults
eval_3 = Evaluate(F="IF(x>0,\"WARNING: The Z value of point 1-3 of the bowcurve is not zero\",\"\")", x=ma.Result)

# ----
drec = DeconstuctRectangle(Rectangle=reference_rectangle_bxd)  # -> BasePlane, XInterval, YInterval

# ---- group: Check if the first three points of the bow intermediate curve are on Z=0
cp_2 = ControlPoints(Curve=input_bow_intermediate_curve)  # -> Points, Weights, Knots
item_2 = ListItem(List=cp_2.Points, Index=0, Wrap=True)  # -> Item, Item1, Item2
pt2num_2 = PointsToNumbers(Points=flatten([item_2.Item, item_2.Item1, item_2.Item2]), Mask=11)  # -> expr("round(x,3)", Numbers)
equals_2 = Equality(FirstNumber=pt2num_2, SecondNumber=0)  # -> Equality, Inequality
ma_2 = MassAddition(Input=flatten(equals_2.Inequality))  # -> Result, PartialResults
eval_4 = Evaluate(F="IF(x>0,\"WARNING: The Z value of point 1-3 of the bow intermediate curve is not zero\",\"\")", x=ma_2.Result)

# ----
combine = CombineData(Input0=sift_2.Output0, Input1=sift.Output1)  # -> Result, Index
eval_5 = Evaluate(F="m*1000/scale", m=depth_doa_m, scale=combine.Result)
eval_6 = Evaluate(F="m*1000/scale", m=waterline_m, scale=combine.Result)
eval_7 = Evaluate(F="m*1000/scale", m=breadth_boa_m, scale=combine.Result)
eval_8 = Evaluate(
    F="if(toggle=true,t_scale,t/scale)",
    t=mean_shell_thickness_mm,
    scale=combine.Result,
    t_scale=plate_thickness_scale_model_mm_fixed,
    toggle=toggle_scale_large_model_scale_1_270)
division = Division(A=1, B=combine.Result)
eval_9 = Evaluate(F="m*1000/scale", m=bilge_radius_m, scale=combine.Result)

eval_10 = Evaluate(F="m*1000/scale", m=tekst_size_m, scale=combine.Result)
eval_11 = Evaluate(F="m*1000/scale", m=dimension_line_size, scale=combine.Result)

eval_12 = Evaluate(F="m*1000/scale", m=length_m, scale=combine.Result)
scale = Scale(Geometry=reference_rectangle_bxd, Center=drec.BasePlane, Factor=division)  # -> Geometry, Transform
scale_2 = Scale(Geometry=input_stern_curve, Center=drec.BasePlane, Factor=division)  # -> Geometry, Transform
end = EndPoints(Curve=input_bow_cl_curve)  # -> Start, End
scale_3 = Scale(Geometry=input_bow_cl_curve, Center=end.Start, Factor=division)  # -> Geometry, Transform
scale_4 = Scale(Geometry=input_bow_intermediate_curve, Center=drec.BasePlane, Factor=division)  # -> Geometry, Transform

# ---- group: Design waterplane
tdesign_depth_loadlineratio = Number(0.85)
eval_13 = Evaluate(F="Doa*Td_D-t_plate", Doa=eval_5, Td_D=tdesign_depth_loadlineratio, t_plate=eval_8)
pt2num_3 = NumbersToPoints(Numbers=eval_13, Mask=11)
xy = XYPlane(Origin=pt2num_3)

# ----
vec = VectorXYZ(XComponent=0, YComponent=0, ZComponent=0)  # -> Vector, Length
panel_4 = Panel("""1
1
1
1
0
0""")
panel_5 = Panel("""0
0
1
1
0
1""")
loft_opt = LoftOptions(Closed=False, Adjust=False, Rebuild=0, Refit=0, Type=1)
bool_volume_related_output = Boolean(toggle_volume_related_output)
button_show_centers = Button()
equals_3 = Equality(FirstNumber=fillingheight_of_tank_in_of_dm, SecondNumber=0)  # -> Equality, Inequality
depth = Number(expr("x*1000", depth_doa_m))  # disabled
and = GateAnd(A=bool_volume_related_output, B=invert(equals_3.Equality))
pt = ConstructPoint(XCoordinate=0, YCoordinate=0, ZCoordinate=depth)  # disabled
and_2 = GateAnd(ToggleVolumeRelatedOutput=toggle_volume_related_output, ToggleCrossAreaCurves=toggle_cross_area_curves)
xy_2 = XYPlane(Origin=pt)  # disabled
sift_3 = SiftPattern(List=ordinates, SiftPattern=and_2)  # -> Output0, Output1
number_of_ordinates = Integer(sift_3.Output1)

# ---- group: handmatige controle invoer true=aan
centroid_height_bulb_transverse_area_m2 = Slider(4, range=0..10)
breadth_m = Slider(32, range=0..40)
transom_area_m2 = Slider(16, range=0..40)
manual_input = BooleanToggle(False)
draft_aft_m = Slider(10, range=0..40)
draft_forward_m = Slider(10, range=0..40)
mainframe_coefficient_c_m = Slider(0.98, range=0..1)
waterline_angle_of_entrance = Slider(12.08, range=0..25)
transverse_area_bulb_m2 = Slider(20, range=0..50)
waterline_length_m = Slider(205, range=0..300)
displacement_m3 = Slider(37500, range=0..400000)
waterplane_area_m2 = Slider(4920, range=0..10000)
lcb = Slider(-0.75, range=-25..25)
wet_hull_area_m2 = Slider(7381.5, range=0..20000)
merge = Merge(
    Data1=flatten(waterline_length_m),
    Data2=flatten(breadth_m),
    Data3=flatten(draft_aft_m),
    Data4=flatten(draft_forward_m),
    Data5=flatten(displacement_m3),
    Data6=flatten(mainframe_coefficient_c_m),
    Data7=flatten(waterplane_area_m2),
    Data8=flatten(lcb),
    Data9=flatten(wet_hull_area_m2),
    Data10=flatten(waterline_angle_of_entrance),
    Data11=flatten(transom_area_m2),
    Data12=flatten(transverse_area_bulb_m2),
    Data13=flatten(centroid_height_bulb_transverse_area_m2))  # -> flatten(Result)

# ---- group: NVT voor MT1458 / Oppervlakken en weerstand coefficient van appendages [m2]
# Info appendage weerstand: Appendage resistance:
# For each appendage type, the first slider allows for the coefficient to be set followed by the submerged area with the second slider.
# 
# Use values given in the publications.
bilge_keels = Slider(1.4, range=1.4..1.401)
stabilizer_fins = Slider(2.8, range=2.8..2.801)
area = Slider(0, range=0..20)
area_2 = Slider(0, range=0..20)
dome = Slider(2.7, range=2.7..2.701)
skeg = Slider(2, range=1.5..2)
area_3 = Slider(0, range=0..20)
shafts = Slider(2, range=2..4)
area_4 = Slider(0, range=0..20)
area_5 = Slider(0, range=0..80)
shaft_brackets = Slider(3, range=3..3.001)
area_6 = Slider(0, range=0..20)
twin_screw_balance_rudders = Slider(2.8, range=2.8..3)
area_7 = Slider(0, range=0..20)
area_8 = Slider(0, range=0..20)
strut_bossings = Slider(3, range=3..3.001)
rudder_behind_skeg = Slider(2, range=1.5..2)
area_9 = Slider(0, range=0..80)
area_10 = Slider(0, range=0..20)
hull_bossings = Slider(2, range=2..2.001)
area_11 = Slider(0, range=0..80)
rudder_behind_stern = Slider(1.3, range=1.3..1.5)
merge_2 = Merge(
    Data1=rudder_behind_skeg,
    Data2=area_11,
    Data3=rudder_behind_stern,
    Data4=area_9,
    Data5=twin_screw_balance_rudders,
    Data6=area_5,
    Data7=shaft_brackets,
    Data8=area_7,
    Data9=skeg,
    Data10=area_8,
    Data11=strut_bossings,
    Data12=area_10,
    Data13=hull_bossings,
    Data14=area_3,
    Data15=shafts,
    Data16=area_6,
    Data17=stabilizer_fins,
    Data18=area_4,
    Data19=dome,
    Data20=area,
    Data21=bilge_keels,
    Data22=area_2)
python = GhPythonScript(k2_matrix=merge_2)  # -> k2, S_app; inputs k2_matrix: list
# ---------- python: Python ----------
__author__ = "jlwou"
__version__ = "2020.02.12"

import rhinoscriptsyntax as rs
table1=k2_matrix[0]
table2=k2_matrix[2]
table3=k2_matrix[4]
table4=k2_matrix[6]
table5=k2_matrix[8]
table6=k2_matrix[10]
table7=k2_matrix[12]
table8=k2_matrix[14]
table9=k2_matrix[16]
table10=k2_matrix[18]
table11=k2_matrix[20]

A_table1=k2_matrix[1]
A_table2=k2_matrix[3]
A_table3=k2_matrix[5]
A_table4=k2_matrix[7]
A_table5=k2_matrix[9]
A_table6=k2_matrix[11]
A_table7=k2_matrix[13]
A_table8=k2_matrix[15]
A_table9=k2_matrix[17]
A_table10=k2_matrix[19]
A_table11=k2_matrix[21]

S_app=A_table1 + A_table2 + A_table3 + A_table4 + A_table5 + A_table6 + A_table7 + A_table8 + A_table9 + A_table10 + A_table11
if S_app==0:
    k2=0
else:
    k2=-1+(table1*A_table1 + table2*A_table2 + table3*A_table3 +table4*A_table4 +table5*A_table5 + table6*A_table6 + table7*A_table7 + table8*A_table8 + table9*A_table9 + table10*A_table10 + table11*A_table11)/(S_app)
# ---------- end python ----------
concat = Concatenate(FragmentA=python.k2, FragmentC=", ", FragmentB=python.S_app)
k2_s_app = Panel(concat)

# ---- group: NVT voor MT1458
transverse_oppervlak_bulb_m2 = Slider(0, range=0..50)
hoogteligging_van_zwaartepunt_transverse = Slider(0, range=0..10)  # "Hoogteligging van zwaartepunt transverse area bulb [m]"
bulb = BooleanToggle(False)

# ---- group: NVT voor MT1458 / Boegschroef
bow_thruster = BooleanToggle(False)
resistance_coefficient_bow_thruster = Slider(0.012, range=0..0.012)
diameter_bow_thruster_tunnel_m = Slider(5, range=0..7)
nr_of_bow_thrusters = Slider(1, range=0..5)

# ---- group: NVT voor MT1458 / Schroef
diameter_prop_m = Slider(8, range=0..10)
nr_of_props = Slider(1, range=1..5)

# ----
button_show_cross_sections = Button()

# ---- group: output m or mm
txt_mm = Text("mm")
txt_m = Text("m")
eval_14 = Evaluate(F="if(output=1,B,A)", output=output_dimension, A=txt_m, B=txt_mm)

# ---- group: Check if end points of curves are inside the reference rectangle BH
X = UnitX(Factor=expr("x*1200", length_m))
end_2 = EndPoints(Curve=input_bow_cl_curve)  # -> Start, End
end_3 = EndPoints(Curve=[input_stern_curve, input_bow_intermediate_curve])  # -> Start, End
move = Move(Geometry=reference_rectangle_bxd, Motion=Vector(-90006, 0, 0))  # -> Geometry, Transform
pt2num_4 = PointsToNumbers(Points=end_2.Start, Mask=11)
extr = Extrude(Base=move.Geometry, Direction=X)
cap = CapHoles(Brep=extr)
equals_4 = Equality(FirstNumber=expr("round(x)", pt2num_4), SecondNumber=0)  # -> Equality, Inequality
brepinc = PointInBrep(Brep=cap, Point=flatten([end_3.Start, end_3.End, end_2.End]), Strict=False)
ma_3 = MassAddition(Input=flatten([equals_4.Inequality, brepinc]))  # -> Result, PartialResults
eval_15 = Evaluate(F="IF(x>0,\"WARNING: an endpoint of a curve is inside the rectangle BH\",\"\")", x=ma_3.Result)

# ----
equals_5 = Equality(FirstNumber=expr("round(x)", [ma_3.Result, ma.Result, ma_2.Result]), SecondNumber=0)  # -> Equality, Inequality
dispatch = Dispatch(List=[eval_15, eval_3, eval_4], DispatchPattern=equals_5.Inequality)  # -> ListA, ListB

# ---- group: Check if end points of curves are inside the reference rectangle BH (continued)
panel_6 = Panel(dispatch.ListA)

# ---- group: Moulded start and endpoints
num = Number(0)
eval_16 = Evaluate(
    F="if(toggle_T_f=TRUE,MIN(Doa-Minimum,MAX(T_or_f-t_plate,Minimum)),MAX(Doa-T_or_f-t_plate,Minimum))",
    Doa=eval_5,
    T_or_f=eval_6,
    t_plate=eval_8,
    toggle_T_f=height_waterline_from_keel_true_or_deck,
    Minimum=num)
eval_17 = Evaluate(F="Doa-t_plate", Doa=eval_5, t_plate=eval_8)
eval_18 = Evaluate(F="Boa-2*t_plate", Boa=eval_7, t_plate=eval_8)
division_2 = Division(A=eval_18, B=2)

# ----
subtraction = Subtraction(A=eval_7, B=eval_18)
panel_7 = Panel(subtraction)

dom = ConstructDomain(DomainStart=expr("-1.1*X", division_2), DomainEnd=expr("1.1*X", division_2))
dom_2 = ConstructDomain(DomainStart=expr("-10", 0), DomainEnd=expr("1.1*X", eval_17))
multiplication = Multiplication(Depth=eval_17, B=1)
Z = UnitZ(Factor=multiplication)
xy_3 = XYPlane(Origin=Z)

# ---- group: Bow curve scaling & placement
x_tremez = Extremes(Curve=scale_3.Geometry, Plane=PlaneXY(0, 0, 0))  # -> Highest, Lowest
movetoplane = MoveToPlane(Geometry=scale_3.Geometry, Plane=PlaneXY(0, 0, 0), Above=True, Below=True)  # -> Geometry, Transform
pdecon = Deconstruct(Point=x_tremez.Lowest)  # -> XComponent, YComponent, ZComponent
pdecon_2 = Deconstruct(Point=x_tremez.Highest)  # -> XComponent, YComponent, ZComponent
subtraction_2 = Subtraction(A=pdecon_2.ZComponent, B=pdecon.ZComponent)
division_3 = Division(A=eval_17, B=subtraction_2)
scale_nu = ScaleNU(Geometry=movetoplane.Geometry, Plane=PlaneXY(0, 0, 0), ScaleX=division_3, ScaleY=1, ScaleZ=division_3)  # -> Geometry, Transform
pcx = CurvePlane(Curve=scale_nu.Geometry, Plane=xy)  # -> Points, ParamsC, ParamsP
x_tremez_2 = Extremes(Curve=scale_nu.Geometry, Plane=PlaneXY(0, 0, 0))  # -> Highest, Lowest
pt2num_5 = PointsToNumbers(Points=pcx.Points, Mask=1)
pt2num_6 = PointsToNumbers(Points=x_tremez_2.Highest, Mask=1)
subtraction_3 = Subtraction(A=pt2num_6, B=pt2num_5)
subtraction_4 = Subtraction(Lpp1=eval_12, B=pt2num_5)
subtraction_5 = Subtraction(Loa2=eval_12, B=subtraction_3)
multiplication_2 = Multiplication(A=subtraction_5, B=lpp_l0_85h)
subtraction_6 = Subtraction(A=multiplication_2, B=pt2num_5)

# ---- group: ALS STUDENT NIET VERANDEREN, keuze om de maximale lengte op Lpp of Loa te zetten
list = ValueList({"Max lengte op basis van Lpp": 0, "Max lengte op basis van Loa": 1}, selected="Max lengte op basis van Loa")
filter_lpp1_of_lpp2 = StreamFilter(Gate=list, Stream0=eval_12, Stream1=multiplication_2)

# ----
multiplication_3 = Multiplication(A=filter_lpp1_of_lpp2, B=midshiplength_of_lpp, C=0.01)

# ---- group: Bow curve scaling & placement (continued)
filter = StreamFilter(Gate=list, Stream0=subtraction_4, Stream1=subtraction_6)
X_2 = UnitX(Factor=filter)
move_2 = Move(Geometry=scale_nu.Geometry, Motion=X_2)  # -> Geometry, Transform

# ----
eval_19 = Evaluate(F="m/scale", m=multiplication_3, scale=combine.Result)
lpp = Panel(filter_lpp1_of_lpp2)

# ---- group: Moulded start and endpoints (continued)
eval_20 = Evaluate(F="Lpp*LocM/100-LMidShip/2", Lpp=filter_lpp1_of_lpp2, LocM=location_of_midship_of_lpp, LMidShip=eval_19)
division_4 = Division(A=filter_lpp1_of_lpp2, B=lpp_l0_85h)
subtraction_7 = Subtraction(A=filter_lpp1_of_lpp2, B=division_4)
eval_21 = Evaluate(F="Lpp-Laft-LMidShip", Lpp=filter_lpp1_of_lpp2, Laft=eval_20, LMidShip=eval_19)
addition = Addition(A=eval_20, B=eval_19)

# ---- group: Main frame generation
pts_of_bilge_curve = Point([Point(0, -3, 0), Point(0, -1.612248345, 0), Point(0, -1.104813525, 0), Point(0, -0.7190296233, 0), Point(0, -0.2595888586, 0.2595901177), Point(0, 6.968148227e-07, 0.7190303202), Point(0, 6.968148227e-07, 1.104814133), Point(0, 6.968148227e-07, 1.612249042), Point(0, 6.968148226e-07, 3)])
weight_numbers = Number([1, 1, 1, 1, 1, 1, 1, 1, 1])
lng = ListLength(List=pts_of_bilge_curve)
knots = KnotVector(Count=lng, Degree=3, Periodic=False)
nurbcrv = NurbsCurve(Points=pts_of_bilge_curve, Weights=weight_numbers, Knots=knots)  # -> Curve, Length, Domain
scale_5 = Scale(Geometry=nurbcrv.Curve, Center=Point(0, 0, 0), Factor=eval_9)  # -> Geometry, Transform
Y = UnitY(Factor=division_2)
multiplication_4 = Multiplication(Depth=eval_17, _11=1.1)
move_3 = Move(Geometry=scale_5.Geometry, Motion=Y)  # -> Geometry, Transform
X_3 = UnitX(Factor=eval_20)
cp_3 = ControlPoints(MainCurve=move_3.Geometry)  # -> Points, Weights, Knots

# ----
# Function if points of bilge radius become beyond midship or depth point.
item_3 = ListItem(List=cp_3.Points, Index=0, Wrap=True)
item_4 = ListItem(List=cp_3.Points, Index=expr("x-1", lng), Wrap=True)
pdecon_3 = Deconstruct(Point=item_3)  # -> XComponent, YComponent, ZComponent
pdecon_4 = Deconstruct(Point=item_4)  # -> XComponent, YComponent, ZComponent
eval_22 = Evaluate(F="if(y≤0,y-1,0)", y=pdecon_3.YComponent)
eval_23 = Evaluate(F="if(Zbilge≥Depth,Zbilge+1,Depth)", Depth=multiplication_4, Zbilge=pdecon_4.ZComponent)
base_pt = ConstructPoint(XCoordinate=0, YCoordinate=flatten(eval_22), ZCoordinate=0)
deck_pt = ConstructPoint(XCoordinate=0, YCoordinate=division_2, ZCoordinate=flatten(eval_23))
merge_3 = Merge(Data1=0, Data2=lng)
ins = InsertItems(List=cp_3.Points, Item=[base_pt, deck_pt], Indices=merge_3, Wrap=True)
ins_2 = InsertItems(List=cp_3.Weights, Item=1, Indices=merge_3, Wrap=True)
lng_2 = ListLength(List=ins)
knots_2 = KnotVector(Count=lng_2, Degree=3, Periodic=False)
nurbcrv_2 = NurbsCurve(Points=ins, Weights=ins_2, Knots=knots_2)  # -> CurveOut, Length, Domain

# ---- group: Set Y=0 of bow curve
mm = Slider(200, range=10..200)
cp_4 = ControlPoints(Curve=move_2.Geometry)  # -> Points, Weights, Knots
pt2num_7 = PointsToNumbers(Points=cp_4.Points, Mask=3)
division_5 = Division(A=mm, Scale=combine.Result)
pt2num_8 = NumbersToPoints(Numbers=pt2num_7, Mask=3)
split = SplitList(List=pt2num_8, Index=1)  # -> ListA, ListB
Y_2 = UnitY(Factor=division_5)  # -> expr("-x", UnitVector)
move_4 = Move(Geometry=split.ListA, Motion=Y_2)  # -> Geometry, Transform
nurbcrv_3 = NurbsCurve(Points=[move_4.Geometry, split.ListB], Weights=cp_4.Weights, Knots=cp_4.Knots)  # -> Curve, Length, Domain
preview = CustomPreview(
    Geometry=nurbcrv_3.Curve,
    Shader={diffuse=RGB(255, 128, 0), emission=RGB(255, 128, 0), shine=0.5, specular=RGB(255, 255, 255), transparency=0})

# ---- group: Midship
move_5 = Move(Geometry=nurbcrv_2.CurveOut, Motion=X_3)  # -> Geometry, Transform
X_4 = UnitX(Factor=eval_19)
crv_main_frame_aft = Curve(move_5.Geometry)
move_6 = Move(Geometry=crv_main_frame_aft, Motion=X_4)  # -> MainframeFwd, Transform

# ----
Y_3 = UnitY(Factor=division_5)  # -> expr("-x/2", UnitVector)
X_5 = UnitX(Factor=subtraction_7)
yz = YZPlane(Origin=X_5)
planesrf = PlaneSurface(Plane=yz, XSize=dom, YSize=dom_2)
input_cutting_stern = Brep(planesrf)

division_6 = Division(A=eval_12, B=1000)
multiplication_5 = Multiplication(A=eval_16, B=0.001)
merge_4 = Merge(
    Data1=flatten(division_6),
    Data2=flatten(breadth_boa_m),
    Data3=flatten(depth_doa_m),
    Data4=flatten(multiplication_5),
    Data5=flatten(lpp_l0_85h),
    Data6=flatten(length_aft_shoulder),
    Data7=flatten(multiplication_3),
    Data8=flatten(location_of_midship_of_lpp),
    Data9=flatten(bilge_radius_m),
    Data10=flatten(length_fwd_shoulder),
    Data11=flatten(location_of_bow_intermediate_curve),
    Data12=flatten(bow_tangency_shear_angle_deg),
    Data13=flatten(heel_deg),
    Data14=flatten(trim_deg),
    Data15=flatten(mean_shell_thickness_mm),
    Data16=flatten(ordinates),
    Data17=flatten(waterlines),
    Data18=flatten(buttocks),
    Data19=flatten(entrance_angle_factor_of_bwl),
    Data20=flatten(x_division_method),
    Data21=flatten(flip_loft_surface))  # -> flatten(Result)
panel_8 = Panel("""Loa 
Boa 
Doa 
Tmoulded 
Lpp/L0.85H 
% Length aft Shoulder 
Midship Length 
Location of midship 
Bilge Radius 
% Length fwd shoulder 
Location of bow intermediate curve 
Bow tangency shear angle 
heel 
trim 
mean shell thickness 
Number of ordinates 
number of waterlines 
number of buttocks 
Entrance angle factor 
X division method 
Flip loft surface """)
panel_9 = Panel("""Lpp 
Boa 
Doa 
Tmoulded 
Lpp/L0.85H 
% Length aft Shoulder 
Midship Length 
Location of midship 
Bilge Radius 
% Length fwd shoulder 
Location of bow intermediate curve 
Bow tangency shear angle 
heel 
trim 
mean shell thickness 
Number of ordinates 
number of waterlines 
number of buttocks 
Entrance angle factor 
X division method 
Flip loft surface """)
filter_lpp1_of_lpp2_2 = StreamFilter(Gate=list, Stream0=panel_9, Stream1=panel_8)
panel_10 = Panel("""m
m
m
m
-
%
m
% of Lpp
m
%
%
deg
deg
deg
mm
-
-
-
% of Bwl
-
-""")
eval_24 = Evaluate(F="round(x,3)", x=merge_4)
case = TextCase(Text="Input Data", Culture=127)  # -> UpperCase, LowerCase
rep = ReplaceText(Text=panel_10, Find="m", Replace=eval_14, RecursiveReplace=False)
concat_2 = Concatenate(FragmentB=filter_lpp1_of_lpp2_2, FragmentA="[", FragmentC=rep, FragmentD="],")
concat_3 = Concatenate(FragmentA=filter_lpp1_of_lpp2_2, FragmentB=eval_24, FragmentC=" ", FragmentD=rep)
concat_4 = Concatenate(FragmentA=concat_2, FragmentB=eval_24)
concat_5 = Concatenate(FragmentB=case.UpperCase)
input_data = Panel([concat_5, concat_4, panel_6])
input_data_2 = Panel([case.UpperCase, concat_3])

# ---- group: Sheared bow curve
mm_2 = Slider(10, range=1..10)
rad_3 = Radians(Degrees=bow_tangency_shear_angle_deg)
prot = RotatePlane(Plane=split.ListA, Angle=rad_3)
deplane = DeconstructPlane(Plane=prot)  # -> Origin, XAxis, YAxis, ZAxis
split_2 = SplitList(List=pt2num_8, Index=1)  # -> ListA, ListB
pl = ConstructPlane(Origin=deplane.Origin, XAxis=deplane.XAxis, YAxis=deplane.ZAxis)
projecta = ProjectAlong(Geometry=split_2.ListB, Plane=pl, Direction=Vector(0, 1, 0))  # -> Geometry, Transform

# ----
division_7 = Division(A=mm_2, Scale=combine.Result)
move_7 = Move(Geometry=split_2.ListA, Motion=Y_3)  # -> Geometry, Transform

# ---- group: Sheared bow curve (continued)
X_6 = UnitX(Factor=division_7)  # -> expr("-X", UnitVector)
move_8 = Move(Geometry=move_7.Geometry, Motion=X_6)  # -> Geometry, Transform
nurbcrv_4 = NurbsCurve(Points=[move_8.Geometry, projecta.Geometry], Weights=cp_4.Weights, Knots=cp_4.Knots)  # -> Curve, Length, Domain
pt2num_9 = PointsToNumbers(Points=move_8.Geometry, Mask=1)
preview_2 = CustomPreview(
    Geometry=nurbcrv_4.Curve,
    Shader={diffuse=RGB(255, 224, 192), emission=RGB(255, 224, 192), shine=0.5, specular=RGB(255, 255, 255), transparency=0})

# ----
subtraction_8 = Subtraction(A=pt2num_9, B=addition)

# ---- group: Set curves for fore and aft shoulder
shoulder_curve_ratio = Slider(4, range=2..10)
division_8 = Division(A=length_fwd_shoulder, B=100)
division_9 = Division(A=length_aft_shoulder, B=100)

# ----
multiplication_6 = Multiplication(A=eval_20, B=division_9)
multiplication_7 = Multiplication(A=subtraction_8, B=division_8)
subtraction_9 = Subtraction(A=shoulder_curve_ratio, B=1)

# ---- group: Set curves for fore and aft shoulder (continued)
division_10 = Division(A=multiplication_7, B=shoulder_curve_ratio)
division_11 = Division(A=multiplication_6, B=shoulder_curve_ratio)
X_7 = UnitX(Factor=division_10)
X_8 = UnitX(Factor=division_11)  # -> expr("-X", UnitVector)
move_9 = Move(Geometry=move_6.MainframeFwd, Motion=X_7)  # -> Geometry, Transform
move_10 = Move(Geometry=crv_main_frame_aft, Motion=X_8)  # -> Geometry, Transform

# ----
multiplication_8 = Multiplication(A=subtraction_9, B=division_10)
multiplication_9 = Multiplication(A=subtraction_9, B=division_11)

# ---- group: Set curves for fore and aft shoulder (continued)
X_9 = UnitX(Factor=multiplication_8)
X_10 = UnitX(Factor=multiplication_9)  # -> expr("-X", UnitVector)
move_11 = Move(Geometry=move_9.Geometry, Motion=X_9)  # -> Geometry, Transform
move_12 = Move(Geometry=move_10.Geometry, Motion=X_10)  # -> Geometry, Transform

# ---- group: choose combinations of mainframe loft curves. 0=six curves (paralel midship); 4=two curves (Mainframe but no paralel midship
panel_11 = Panel("""1
0
1
1
0
0""")
panel_12 = Panel("""0
0
1
1
1
1""")
panel_13 = Panel("""0
0
1
1
0
0""")
panel_14 = Panel("""1
0
1
1
0
1""")
panel_15 = Panel("""1
1
1
1
1
1""")
filter_2 = StreamFilter(
    Gate=paralel_midship_combinations,
    Stream0=panel_13,
    Stream1=panel_14,
    Stream2=panel_15,
    Stream3=panel_11,
    Stream4=panel_4,
    Stream5=panel_5,
    Stream6=panel_12)
dispatch_2 = Dispatch(
    List=flatten([move_12.Geometry, move_10.Geometry, crv_main_frame_aft, move_6.MainframeFwd, move_9.Geometry, move_11.Geometry]),
    DispatchPattern=filter_2)  # -> ListA, ListB
preview_3 = CustomPreview(
    Geometry=dispatch_2.ListA,
    Shader={diffuse=RGB(128, 64, 0), emission=RGB(0, 0, 0), shine=0.5, specular=RGB(255, 255, 255), transparency=0})

# ---- group: scale factors for frames by hand
input_reference_bxd = Curve(scale.Geometry)
box_corners = BoxCorners(Box=input_reference_bxd)  # -> CornerA, CornerB, CornerC, CornerD, CornerE, CornerF, CornerG, CornerH
drec_2 = DeconstuctRectangle(Rectangle=input_reference_bxd)  # -> BasePlane, XInterval, YInterval

# ----
subtraction_10 = Subtraction(A=box_corners.CornerG, B=box_corners.CornerA)
rev = Reverse(Vector=box_corners.CornerA)

# ---- group: scale factors for frames by hand (continued)
pdecon_5 = Deconstruct(Point=subtraction_10)  # -> XComponent, YComponent, ZComponent
division_12 = Division(A=division_2, B=pdecon_5.YComponent)
division_13 = Division(A=eval_17, B=pdecon_5.ZComponent)

# ----
move_13 = Move(Geometry=scale_4.Geometry, Motion=rev)  # -> Geometry, Transform
move_14 = Move(Geometry=scale_2.Geometry, Motion=rev)  # -> Geometry, Transform

# ---- group: stern curve scaling and placement
scale_nu_2 = ScaleNU(Geometry=move_14.Geometry, Plane=PlaneXY(0, 0, 0), ScaleX=1, ScaleY=division_12, ScaleZ=division_13)  # -> Geometry, Transform
cp_5 = ControlPoints(Curve=scale_nu_2.Geometry)  # -> Points, Weights, Knots
pdecon_6 = Deconstruct(Point=cp_5.Points)  # -> XComponent, YComponent, ZComponent
pt_2 = ConstructPoint(XCoordinate=0, YCoordinate=pdecon_6.YComponent, ZCoordinate=pdecon_6.ZComponent)
nurbcrv_5 = NurbsCurve(Points=pt_2, Weights=cp_5.Weights, Knots=cp_5.Knots)  # -> Curve, Length, Domain
X_11 = UnitX(Factor=subtraction_7)
move_15 = Move(Geometry=nurbcrv_5.Curve, Motion=X_11)  # -> Geometry, Transform
preview_4 = CustomPreview(
    Geometry=move_15.Geometry,
    Shader={diffuse=RGB(255, 0, 255), emission=RGB(255, 0, 255), shine=0.5, specular=RGB(255, 255, 255), transparency=0})

# ---- group: Intermediate bow curve scaling and placement
scale_nu_3 = ScaleNU(Geometry=move_13.Geometry, Plane=PlaneXY(0, 0, 0), ScaleX=1, ScaleY=division_12, ScaleZ=division_13)  # -> Geometry, Transform
addition_2 = Addition(A=multiplication_7, B=addition)
division_14 = Division(A=location_of_bow_intermediate_curve, B=100)

# ----
subtraction_11 = Subtraction(A=pt2num_9, B=addition_2)
multiplication_10 = Multiplication(A=subtraction_11, B=division_14)

# ---- group: Intermediate bow curve scaling and placement (continued)
addition_3 = Addition(A=addition_2, B=multiplication_10)
X_12 = UnitX(Factor=addition_3)
move_16 = Move(Geometry=scale_nu_3.Geometry, Motion=X_12)  # -> Geometry, Transform
preview_5 = CustomPreview(
    Geometry=move_16.Geometry,
    Shader={diffuse=RGB(255, 0, 0), emission=RGB(255, 0, 0), shine=0.5, specular=RGB(255, 255, 255), transparency=0})

# ---- group: Sort loft curves by Xstart
crv = Curve(flatten([nurbcrv_3.Curve, nurbcrv_4.Curve, move_16.Geometry, move_15.Geometry, dispatch_2.ListA]))
end_4 = EndPoints(Curve=crv)  # -> Start, End
pdecon_7 = Deconstruct(Point=end_4.Start)  # -> XComponent, YComponent, ZComponent
sort = SortList(Keys=pdecon_7.XComponent, ValuesA=crv)  # -> flatten(Keys), flatten(ValuesA)

# ---- group: Sort by X and Loft
loft = Loft(Curves=sort.ValuesA, Options=loft_opt)

# ----
bbox = BoundingBox(Content=loft, Plane=PlaneXY(0, 0, 0))  # -> Box, Box_2
box_corners_2 = BoxCorners(Box=bbox.Box)  # -> CornerA, CornerB, CornerC, CornerD, CornerE, CornerF, CornerG, CornerH
pt2num_10 = PointsToNumbers(Points=box_corners_2.CornerG, Mask=1)

# ---- group: Cutting Deck
dom_3 = ConstructDomain(DomainStart=expr("1.1*X", subtraction_7), DomainEnd=pt2num_10)
dom_4 = ConstructDomain(DomainStart=expr("-X", eval_18), DomainEnd=eval_18)
Z_2 = UnitZ(Factor=eval_17)
xy_4 = XYPlane(Origin=Z_2)
planesrf_2 = PlaneSurface(Plane=xy_4, XSize=dom_3, YSize=dom_4)

# ----
input_half_hull_surface = Brep(loft)
input_cutting_deck = Brep(planesrf_2)

# ----
# Set the surface direction to down and fwd.
# Needed for functions like
# solid intersection and solid difference.
example_direction = Guide(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)
example_direction_2 = Guide(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)
debrep = DeconstructBrep(Brep=input_cutting_stern)  # -> Faces, Edges, Vertices
debrep_2 = DeconstructBrep(Brep=input_cutting_deck)  # -> Faces, Edges, Vertices
flip = Flip(Surface=debrep.Faces, Guide=example_direction)  # -> Surface, Result
flip_2 = Flip(Surface=debrep_2.Faces, Guide=example_direction_2)  # -> Surface, Result

# ---- group: Flip surface
# Set the surface direction to outward.
# Needed for functions like
# solid intersection and solid difference.
sift_4 = SiftPattern(List=input_half_hull_surface, SiftPattern=flip_loft_surface)  # -> Output0, Output1
flip_3 = Flip(Surface=sift_4.Output0)  # -> Surface, Result
combine_2 = CombineData(Input0=flip_3.Surface, Input1=sift_4.Output1)  # -> Result, Index

# ----
# join hull surfaces if
# multiple Breps are used
join = BrepJoin(Breps=combine_2.Result)  # -> Breps, Closed
join_2 = BrepJoin(Breps=flip.Surface)  # -> Breps, Closed
join_3 = BrepJoin(Breps=flip_2.Surface)  # -> Breps, Closed

deck = Brep(join_3.Breps)
stern = Brep(join_2.Breps)

# ----
# LBH of Bounding Box of stern
bbox_2 = BoundingBox(Content=stern, Plane=PlaneXY(0, 0, 0))  # -> Box, Box_2
box_corners_3 = BoxCorners(Box=bbox_2.Box)  # -> CornerA, CornerB, CornerC, CornerD, CornerE, CornerF, CornerG, CornerH
pdecon_8 = Deconstruct(Point=box_corners_3.CornerG)  # -> XComponent, YComponent, ZComponent
pdecon_9 = Deconstruct(Point=box_corners_3.CornerA)  # -> XComponent, YComponent, ZComponent

# ----
# LBH of Bounding Box of deck
bbox_3 = BoundingBox(Content=deck, Plane=PlaneXY(0, 0, 0))  # -> Box, Box_2
box_corners_4 = BoxCorners(Box=bbox_3.Box)  # -> CornerA, CornerB, CornerC, CornerD, CornerE, CornerF, CornerG, CornerH
pdecon_10 = Deconstruct(Point=box_corners_4.CornerA)  # -> XComponent, YComponent, ZComponent
pdecon_11 = Deconstruct(Point=box_corners_4.CornerG)  # -> XComponent, YComponent, ZComponent

# ----
# Cuts the shell by the centerline plane and the deckplane and selects the shell by the location of the COA.
pxs = PlaneThroughShape(Plane=xy_3, Shape=join.Breps, Inflate=1, SectionLogic=False)
pxs_2 = PlaneThroughShape(Plane=Plane(origin=(0, 0, 0), x=(0, 0, 1), y=(1, 0, 0)), Shape=join.Breps, Inflate=1, SectionLogic=False)
area_12 = Area(Geometry=pxs_2)  # -> Area, Centroid
area_13 = Area(Geometry=pxs)  # -> Area, Centroid
scale_6 = Scale(Geometry=pxs_2, Center=area_12.Centroid, Factor=1.5)  # -> Geometry, Transform
scale_7 = Scale(Geometry=pxs, Center=area_13.Centroid, Factor=1.5)  # -> Geometry, Transform
split_3 = SplitBrep(Brep=join.Breps, Cutter=scale_6.Geometry)

split_4 = SplitBrep(Brep=split_3, Cutter=scale_7.Geometry)  # -> flatten(Result)

boxprop = BoxProperties(Box=split_4)  # -> Center, Diagonal, Area, Volume, Degeneracy

pdecon_12 = Deconstruct(Point=boxprop.Center)  # -> XComponent, YComponent, ZComponent
larger = LargerThan(FirstNumber=pdecon_12.YComponent, SecondNumber=0)  # -> LargerThan, OrEqualTo
smaller = SmallerThan(FirstNumber=pdecon_12.ZComponent, SecondNumber=multiplication)  # -> SmallerThan, OrEqualTo
and_3 = GateAnd(A=larger.LargerThan, B=smaller.SmallerThan)
dispatch_3 = Dispatch(List=split_4, DispatchPattern=and_3)  # -> ListA, ListB

# ----
# PS & SB Shell
mirror = Mirror(Geometry=dispatch_3.ListA, Plane=Plane(origin=(0, 0, 0), x=(0, 0, 1), y=(1, 0, 0)))  # -> Geometry, Transform
ps_sb_shell = Brep([mirror.Geometry, dispatch_3.ListA])
join_4 = BrepJoin(Breps=flatten(ps_sb_shell))  # -> Breps, Closed

# ---- group: Waterplane at zero heel and trim
# Selects the hull cutted by a deck in rhino,
# or the hull by the depth of the loft curves
# (if the deck is not provided or
# if the deck does not intersect the hull.)
Z_3 = UnitZ(T_loading_condition=eval_16)
xy_5 = XYPlane(Origin=Z_3)
sec = BrepPlane(Brep=join_4.Breps, Plane=xy_5)  # -> Curves, Points
end_5 = EndPoints(Curve=sec.Curves)  # -> Start, End
ln = Line(StartPoint=end_5.Start, EndPoint=end_5.End)
join_5 = JoinCurves(Curves=[sec.Curves, ln], Preserve=False)
boundary = BoundarySurfaces(Edges=join_5)
area_14 = Area(Geometry=boundary)  # -> Area, Centroid

# ----
# Selects the SB hull (Ysb<Yps)
bbox_4 = BoundingBox(Content=[dispatch_3.ListA, mirror.Geometry], Plane=PlaneXY(0, 0, 0))  # -> Box, Box_2
boxprop_2 = BoxProperties(Box=bbox_4.Box)  # -> Center, Diagonal, Area, Volume, Degeneracy
pt2num_11 = PointsToNumbers(Points=boxprop_2.Center, Mask=6)
list_2 = ValueList({"SB shell": 0, "PS shell": 1}, selected="SB shell")
sort_2 = SortList(Keys=pt2num_11, ValuesA=[dispatch_3.ListA, mirror.Geometry])  # -> Keys, ValuesA
item_5 = ListItem(List=sort_2.ValuesA, Index=list_2, Wrap=True)

# ---- group: Waterline with trim and heel
yz_2 = YZPlane(Origin=area_14.Centroid)
rotate = Rotate(Geometry=xy_5, Angle=rad, Plane=yz_2)  # -> Geometry, Transform
xz = XZPlane(Origin=area_14.Centroid)
rotate_2 = Rotate(Geometry=rotate.Geometry, Angle=rad_2, Plane=xz)  # -> Geometry, Transform
sec_2 = BrepPlane(Brep=join_4.Breps, Plane=rotate_2.Geometry)  # -> Curves, Points

# ----
pt2num_12 = PointsToNumbers(Points=area_14.Centroid, Mask=1)

# ---- group: Calculation of Ta and Tf (at loadlines) and Tmirror
pcx_2 = CurvePlane(Curve=move_15.Geometry, Plane=Plane(origin=(0, 0, 0), x=(0, 0, 1), y=(1, 0, 0)))  # -> Points, ParamsC, ParamsP
pt2num_13 = PointsToNumbers(Points=pcx_2.Points, Mask=1)
lpp_2 = Number(flatten(filter_lpp1_of_lpp2))
eval_25 = Evaluate(F="T-tan(trim)*(x-y)", x=pt2num_12, y=pt2num_13, trim=rad_2, T=eval_16, Lpp=lpp_2)
eval_26 = Evaluate(F="T-tan(trim)*x", x=pt2num_12, trim=rad_2, T=eval_16, Lpp=lpp_2)
eval_27 = Evaluate(F="T+tan(trim)*(Lpp-x)", x=pt2num_12, trim=rad_2, T=eval_16, Lpp=lpp_2)

# ----
# LBH of Bounding Box of SB shell
# Check of Y value of cutting CL
# Should be almost zero
# PS =+
box_corners_5 = BoxCorners(Box=item_5)  # -> CornerA, CornerB, CornerC, CornerD, CornerE, CornerF, CornerG, CornerH
pt2num_14 = PointsToNumbers(Points=box_corners_5.CornerE, Mask=11)  # -> expr("ABS(x)", HWrtZ0)
pt2num_15 = PointsToNumbers(Points=box_corners_5.CornerA, Mask=1)
pt2num_16 = PointsToNumbers(Points=box_corners_5.CornerC, Mask=6)

boxprop_3 = BoxProperties(Box=item_5)  # -> Center, Diagonal, Area, Volume, Degeneracy
pdecon_13 = Deconstruct(Point=boxprop_3.Diagonal)  # -> XComponent, expr("ABS(x)", YComponent), expr("ABS(x)", ZComponent)
panel_16 = Panel(sec_2.Curves)

# ---- group: Shows Centre of Floatation
# Centre of Floatation untrimmed
pdecon_14 = Deconstruct(Point=area_14.Centroid)  # -> XComponent, YComponent, ZComponent; disabled
eval_28 = Evaluate(
    F="Format(\"2. COV_whole_ship_xyz {0:0.000}, {1:0.000}, {2:0.000} m\", x/1000, 0, z/1000)",
    x=pdecon_14.XComponent,
    y=pdecon_14.YComponent,
    z=pdecon_14.ZComponent)  # disabled
panel_17 = Panel("  COF WPA")  # disabled
pt_3 = ConstructPoint(XCoordinate=pdecon_14.XComponent, YCoordinate=0, ZCoordinate=pdecon_14.ZComponent)  # disabled
sift_5 = SiftPattern(List=pt_3, SiftPattern=button_show_centers)  # -> Output0, Output1; disabled
line = LineSDL(Start=sift_5.Output1, Direction=Vector(1196.036814, 0, 1196.036814), Length=expr("x*2", eval_10))  # disabled
panel_18 = Panel(eval_28)  # disabled
markdim = MarkerDimension(Line=line, Text=panel_17, Size=eval_10)  # disabled

# ----
# Waterline of loading condition
# Sorts the largest waterline
# in case of multiple closed waterlines
# Calculation of Lwl and Bwl
bbox_5 = BoundingBox(Content=sec_2.Curves, Plane=PlaneXY(0, 0, 0))  # -> Box, Box_2
boxprop_4 = BoxProperties(Box=bbox_5.Box)  # -> Center, Diagonal, Area, Volume, Degeneracy
sort_3 = SortList(Keys=boxprop_4.Diagonal, ValuesA=bbox_5.Box)  # -> Keys, ValuesA
item_6 = ListItem(List=sort_3.ValuesA, Index=-1, Wrap=True)
box_corners_6 = BoxCorners(Box=item_6)  # -> CornerA, CornerB, CornerC, CornerD, CornerE, CornerF, CornerG, CornerH
dist = Distance(PointA=box_corners_6.CornerA, PointB=box_corners_6.CornerB)  # -> flatten(Distance)
dist_2 = Distance(PointA=box_corners_6.CornerA, PointB=box_corners_6.CornerD)  # -> flatten(Distance)
lpp_3 = Number(flatten(filter_lpp1_of_lpp2))
eval_29 = Evaluate(F="Lpp*Bwl*T", Lpp=lpp_3, Bwl=dist_2, T=eval_16)
eval_30 = Evaluate(F="Lwl*Bwl*T", Lwl=dist, Bwl=dist_2, T=eval_16)

# ----
# Waterline_Loading_Condition
end_6 = EndPoints(Curve=sec_2.Curves)  # -> Start, End
ln_2 = Line(StartPoint=end_6.Start, EndPoint=end_6.End)
swatch_hull_below_wl = ColourSwatch(SwatchColor=RGB(0, 7, 255))
join_6 = JoinCurves(Curves=flatten([sec_2.Curves, ln_2]), Preserve=False)
waterline = CustomPreview(Geometry=[ln_2, sec_2.Curves], Shader=swatch_hull_below_wl)
bbox_6 = BoundingBox(Content=join_6, Plane=PlaneXY(0, 0, 0))  # -> Box, Box_2
boxprop_5 = BoxProperties(Box=bbox_6.Box)  # -> Center, Diagonal, Area, Volume, Degeneracy
sort_4 = SortList(Keys=boxprop_5.Diagonal, ValuesA=join_6)  # -> Keys, ValuesA
item_7 = ListItem(List=sort_4.ValuesA, Index=-1, Wrap=True)

# ----
# Loadline convention waterline at 0.85D
Z_4 = UnitZ(Tdesign=eval_13)  # disabled
xy_6 = XYPlane(Origin=Z_4)  # disabled
sec_3 = BrepPlane(Brep=item_5, Plane=xy_6)  # -> Curves, Points; disabled
mirror_2 = Mirror(Geometry=sec_3.Curves, Plane=Plane(origin=(0, 0, 0), x=(0, 0, 1), y=(1, 0, 0)))  # -> Waterline, Transform; disabled
end_7 = EndPoints(Curve=sec_3.Curves)  # -> Start, End; disabled
end_8 = EndPoints(Curve=mirror_2.Waterline)  # -> Start, End; disabled
swatch_hull_below_wl_2 = ColourSwatch(SwatchColor=RGB(0, 183, 255))  # disabled
ln_3 = Line(StartPoint=end_7.Start, EndPoint=end_8.Start)  # disabled
waterline_2 = CustomPreview(Geometry=[mirror_2.Waterline, sec_3.Curves, ln_3], Shader=swatch_hull_below_wl_2)  # disabled

multiplication_11 = Multiplication(Loa=pdecon_13.XComponent, B0999=0.999)
multiplication_12 = Multiplication(Hoa=pt2num_14, B0999=0.999)
multiplication_13 = Multiplication(Boa=pdecon_13.YComponent, B0999=-0.999)

# ----
# LINESPLAN
panel_19 = Panel(pt2num_16)
toggle_lines_plan = BooleanToggle(True)
sift_6 = SiftPattern(NrOfButtocks=buttocks, SiftPattern=toggle_lines_plan)  # -> Output0, Output1
sift_7 = SiftPattern(NrOfFrames=ordinates, SiftPattern=toggle_lines_plan)  # -> Output0, Output1
sift_8 = SiftPattern(NrOfWL=waterlines, SiftPattern=toggle_lines_plan)  # -> Output0, Output1
sift_9 = SiftPattern(SBShell=item_5, SiftPattern=toggle_lines_plan)  # -> Output0, Output1
line_2 = LineSDL(StartPt=box_corners_5.CornerA, Direction=Vector(1, 0, 0), Length=multiplication_11)
line_3 = LineSDL(StartPt=box_corners_5.CornerE, Direction=Vector(0, 0, -1), Length=multiplication_12)
line_4 = LineSDL(StartPt=Point(0, 0, 0), Direction=Vector(0, 1, 0), Length=multiplication_13)
frm = PerpFrames(Curve=line_2, Number=sift_7.Output1, Align=True)  # -> Frames, Parameters
frm_2 = PerpFrames(Curve=line_4, Number=sift_6.Output1, Align=True)  # -> Frames, Parameters
frm_3 = PerpFrames(Curve=line_3, Number=sift_8.Output1, Align=True)  # -> Frames, Parameters
sec_frames = BrepPlane(Brep=sift_9.Output1, Plane=frm.Frames)  # -> Curves, Points
split_5 = SplitList(List=flatten(sec_frames.Curves), Index=expr("x/2", sift_7.Output1))  # -> ListA, ListB

# ----
# Bake your
# 3D lines plan
# over here
mirror_3 = Mirror(Geometry=split_5.ListA, Plane=Plane(origin=(0, 0, 0), x=(0, 0, 1), y=(1, 0, 0)))  # -> FramesAftShip, Transform
frames_foreship = Curve(split_5.ListB)
sec_waterlines = BrepPlane(Brep=sift_9.Output1, Plane=frm_3.Frames)  # -> Curves, Points
sec_buttocks = BrepPlane(Brep=sift_9.Output1, Plane=frm_2.Frames)  # -> Curves, Points

# ----
# LBH of Bounding Box of Bare Hull
bbox_7 = BoundingBox(Content=join_4.Breps, Plane=PlaneXY(0, 0, 0))  # -> Box, Box_2
box_corners_7 = BoxCorners(Box=bbox_7.Box)  # -> CornerA, CornerB, CornerC, CornerD, CornerE, CornerF, CornerG, CornerH
pdecon_15 = Deconstruct(Point=box_corners_7.CornerG)  # -> XComponent, YComponent, ZComponent
pdecon_16 = Deconstruct(Point=box_corners_7.CornerA)  # -> XComponent, YComponent, ZComponent

preview_6 = CustomPreview(
    Geometry=sec_buttocks.Curves,
    Shader={diffuse=RGB(255, 128, 0), emission=RGB(255, 128, 0), shine=1, specular=RGB(255, 255, 255), transparency=0})
preview_7 = CustomPreview(
    Geometry=[mirror_3.FramesAftShip, frames_foreship],
    Shader={diffuse=RGB(0, 255, 0), emission=RGB(0, 255, 0), shine=1, specular=RGB(255, 255, 255), transparency=0})
preview_8 = CustomPreview(
    Geometry=sec_waterlines.Curves,
    Shader={diffuse=RGB(0, 255, 255), emission=RGB(0, 255, 255), shine=1, specular=RGB(255, 255, 255), transparency=0})

eval_31 = Evaluate(F="(X+Y)/2", x=pdecon_9.ZComponent, y=pdecon_16.ZComponent)
eval_32 = Evaluate(F="(X+Y)/2", x=pdecon_10.YComponent, y=pdecon_16.YComponent)
eval_33 = Evaluate(F="(X+Y)/2", x=pdecon_15.XComponent, y=pdecon_11.XComponent)
eval_34 = Evaluate(F="(X+Y)/2", x=pdecon_10.XComponent, y=pdecon_16.XComponent)
eval_35 = Evaluate(F="(X+Y)/2", x=pdecon_11.YComponent, y=pdecon_15.YComponent)
min = Minimum(A=pdecon_9.XComponent, B=pdecon_16.XComponent)
eval_36 = Evaluate(F="(X+Y)/2", x=pdecon_8.ZComponent, y=pdecon_16.ZComponent)
eval_37 = Evaluate(F="(X+Y)/2", x=pdecon_9.ZComponent, y=pdecon_16.ZComponent)
eval_38 = Evaluate(F="(X+Y)/2", x=pdecon_9.YComponent, y=pdecon_16.YComponent)
eval_39 = Evaluate(F="(X+Y)/2", x=pdecon_15.XComponent, y=pdecon_11.XComponent)
eval_40 = Evaluate(F="(X+Y)/2", x=pdecon_8.YComponent, y=pdecon_15.YComponent)
pt_4 = ConstructPoint(XCoordinate=expr("1.1*x", eval_33), YCoordinate=eval_35, ZCoordinate=pdecon_11.ZComponent)
pt_5 = ConstructPoint(XCoordinate=eval_34, YCoordinate=eval_32, ZCoordinate=pdecon_9.ZComponent)
pt_6 = ConstructPoint(XCoordinate=expr("1.1*x", eval_39), YCoordinate=eval_40, ZCoordinate=pdecon_8.ZComponent)
pt_7 = ConstructPoint(XCoordinate=min, YCoordinate=eval_38, ZCoordinate=eval_37)
box = Box2Pt(PointA=pt_5, PointB=pt_4, Plane=PlaneXY(0, 0, 0))
box_2 = Box2Pt(PointA=pt_7, PointB=pt_6, Plane=PlaneXY(0, 0, 0))

# ----
# Box with stern
sdiff = SolidDifference(BrepsA=box_2, BrepsB=stern)

# ----
# Box with deck
sdiff_2 = SolidDifference(BrepsA=box, BrepsB=deck)

# ----
# Box with deck and stern
sint = SolidIntersection(BrepsA=sdiff, BrepsB=sdiff_2)

sift_10 = SiftPattern(List=join_4.Breps, SiftPattern=toggle_volume_related_output)  # -> Output0, Output1

# ----
# SOLID HULL
# Right click on the above.
# Choose "Bake".
# Select the layer to bake in
sint_2 = SolidIntersection(BrepsA=sint, BrepsB=sift_10.Output1)

pt_max_xyz_of_bbox_of_bare_hull = Point(box_corners_7.CornerG)

panel_20 = Panel("Main Dimensions(Moulded)")
panel_21 = Panel("""Loa  
B 
H 
Lpp 
Lwl 
X midship aft 
X midship fwd 
Bilge Radius """)
merge_5 = Merge(
    Data1=flatten(pdecon_13.XComponent),
    Data2=flatten(eval_18),
    Data3=flatten(eval_17),
    Data4=flatten(filter_lpp1_of_lpp2),
    Data5=flatten(dist),
    Data6=flatten(eval_20),
    Data7=flatten(addition),
    Data8=flatten(eval_9))  # -> flatten(Result)
division_15 = Division(A=merge_5, B=output_dimension)
eval_41 = Evaluate(F="round(x,3)", x=division_15)
panel_22 = Panel("""m
m
m
m
m
m
m
m""")
rep_2 = ReplaceText(Text=panel_22, Find="m", Replace=eval_14, RecursiveReplace=False)
concat_6 = Concatenate(FragmentB=panel_21, FragmentA="[", FragmentC=rep_2, FragmentD="],")
concat_7 = Concatenate(FragmentA=panel_21, FragmentB=eval_41, FragmentC=" ", FragmentD=rep_2)
concat_8 = Concatenate(FragmentA=concat_6, FragmentB=eval_41)
concat_9 = Concatenate()
main_dimensions = Panel([concat_9, concat_8])
main_dimensions_2 = Panel(concat_7)

panel_23 = Panel("""T moulded 
T aft at app 
T fwd at fpp 
heel """)
merge_6 = Merge(Data1=flatten(eval_16), Data2=flatten(eval_26), Data3=flatten(eval_27))  # -> flatten(Result)
division_16 = Division(A=merge_6, B=output_dimension)
merge_7 = Merge(Data1=flatten(division_16), Data2=flatten(heel_deg))  # -> flatten(Result)
case_2 = TextCase(Text="Loading Condition", Culture=127)  # -> UpperCase, LowerCase
panel_24 = Panel("""m
m
m
deg""")
rep_3 = ReplaceText(Text=panel_24, Find="m", Replace=eval_14, RecursiveReplace=False)
eval_42 = Evaluate(F="round(x,3)", x=merge_7)
concat_10 = Concatenate(FragmentB=panel_23, FragmentA="[", FragmentC=rep_3, FragmentD="],")
concat_11 = Concatenate(FragmentA=panel_23, FragmentB=eval_42, FragmentC=" ", FragmentD=rep_3)
concat_12 = Concatenate(FragmentA=concat_10, FragmentB=eval_42)
concat_13 = Concatenate(FragmentB=case_2.UpperCase)
main_dimensions_3 = Panel([concat_13, concat_12])
main_dimensions_4 = Panel([case_2.UpperCase, concat_11])

# ----
# OUTPUT
# Right click on the above.
# Choose "Bake".
# Select the layer to bake in
# READ OUT OF ALL DATA
# Set all toggles on true, otherwise some data will be missing. Right mouse click in the output panel below and choose 'Copy Data Only' and paste this in spreadsheet or a text file.
# Use the function Text to Columns in Excel>Tab Data. Use comma (,) as delimiter and a point (.) as decimal qualifier.
solid_hull = Brep(sint_2)

# ----
# Angle measurement on Waterline
X_13 = UnitX(Factor=addition)
yz_3 = YZPlane(Origin=X_13)
pxs_3 = PlaneThroughShape(Plane=yz_3, Shape=item_7, Inflate=1, SectionLogic=False)
split_6 = SplitWithBrep(Curve=item_7, Brep=pxs_3)  # -> Curve, Points
midpt = CurveMiddle(Curve=split_6.Curve)
division_17 = Division(A=entrance_angle_factor_of_bwl, B=100)
pt2num_17 = PointsToNumbers(Points=midpt, Mask=1)
sort_5 = SortList(Keys=pt2num_17, ValuesA=split_6.Curve)  # -> Keys, ValuesA
item_8 = ListItem(List=sort_5.ValuesA, Index=-1, Wrap=True)
pxs_4 = PlaneThroughShape(Plane=Plane(origin=(0, 0, 0), x=(0, 0, 1), y=(1, 0, 0)), Shape=item_8, Inflate=1, SectionLogic=False)
split_7 = SplitWithBrep(Curve=item_8, Brep=pxs_4)  # -> Curve, Points
midpt_2 = CurveMiddle(Curve=split_7.Curve)
pt2num_18 = PointsToNumbers(Points=midpt_2, Mask=11)
sort_6 = SortList(Keys=pt2num_18, ValuesA=split_7.Curve)  # -> Keys, ValuesA
item_9 = ListItem(List=sort_6.ValuesA, Index=-1, Wrap=True)
end_9 = EndPoints(Curve=item_9)  # -> Start, End
pt2num_19 = PointsToNumbers(Points=[end_9.Start, end_9.End], Mask=3)
pt2num_20 = NumbersToPoints(Numbers=pt2num_19, Mask=3)
dispatch_4 = Dispatch(List=pt2num_20, DispatchPattern=[True, False])  # -> ListA, ListB
ln_4 = Line(StartPoint=dispatch_4.ListB, EndPoint=dispatch_4.ListA)

multiplication_14 = Multiplication(HalfBm=division_2, B=division_17)

Y_4 = UnitY(Factor=expr("-x", multiplication_14))
Y_5 = UnitY(Factor=multiplication_14)
xz_2 = XZPlane(Origin=[Y_5, Y_4])
pcx_3 = CurvePlane(Curve=item_9, Plane=xz_2)  # -> Points, ParamsC, ParamsP
null = NullItem(Item=flatten(pcx_3.ParamsC))  # -> NullFlags, InvalidFlags, Description
dispatch_5 = Dispatch(List=flatten(pcx_3.ParamsC), DispatchPattern=null.NullFlags)  # -> ListA, ListB
eval_43 = EvaluateCurve(Curve=item_9, Parameter=dispatch_5.ListB)  # -> Point, expr("-x", Tangent), Angle
line_5 = LineSDL(Start=eval_43.Point, Direction=eval_43.Tangent, Length=eval_11)
end_10 = EndPoints(Curve=line_5)  # -> Start, End
line_6 = LineSDL(Start=eval_43.Point, Direction=ln_4, Length=eval_11)
angle = Angle(VectorA=eval_43.Tangent, VectorB=line_6)  # -> Angle, Reflex
deg = Degrees(Radians=angle.Angle)
end_11 = EndPoints(Curve=line_6)  # -> Start, End
eval_44 = Evaluate(F="min(x,180-x)", x=deg)
angledim = AngularDimension(Center=eval_43.Point, PointA=end_11.End, PointB=end_10.End, Reflex=False, Text="{0:0.00}°", Size=eval_10)

# ---- group: Box for draught
# Box for Draught
t_moulded_loading_condition = Number(eval_16)
pdecon_17 = Deconstruct(Point=box_corners_5.CornerA)  # -> XComponent, YComponent, ZComponent
pdecon_18 = Deconstruct(Point=box_corners_5.CornerG)  # -> XComponent, YComponent, ZComponent
pt_8 = ConstructPoint(XCoordinate=expr("x-1000", pdecon_17.XComponent), YCoordinate=0, ZCoordinate=t_moulded_loading_condition)  # disabled
pt_9 = ConstructPoint(
    XCoordinate=expr("x-20000", pdecon_17.XComponent),
    YCoordinate=expr("-x", pdecon_17.YComponent),
    ZCoordinate=t_moulded_loading_condition)
pt_10 = ConstructPoint(XCoordinate=pdecon_18.XComponent, YCoordinate=pdecon_17.YComponent, ZCoordinate=-20000)
box_3 = Box2Pt(PointA=pt_9, PointB=pt_10, Plane=PlaneXY(0, 0, 0))

# ----
pt_11 = ConstructPoint(XCoordinate=expr("x-20000", pdecon_17.XComponent), YCoordinate=0, ZCoordinate=t_moulded_loading_condition)

# ---- group: Box for draught (continued)
scale_nu_4 = ScaleNU(Geometry=box_3, Plane=pt_11, ScaleX=1.2, ScaleY=1.1, ScaleZ=1.1)  # -> Geometry, Transform

# ---- group: Simplified trim and heel. Only valid for small angles (<7 deg)
rotate_3 = Rotate(Geometry=scale_nu_4.Geometry, Angle=rad, Plane=yz_2)  # -> Geometry, Transform
rotate_4 = Rotate(Geometry=rotate_3.Geometry, Angle=rad_2, Plane=xz)  # -> Geometry, Transform

# ---- group: Box for draught (continued)
box_corners_8 = BoxCorners(Box=rotate_4.Geometry)  # -> CornerA, CornerB, CornerC, CornerD, CornerE, CornerF, CornerG, CornerH

# ---- group: Box of aft, mid, fore-ship over full Depth
xstern_startmidship_startforeship_lpp = Panel([subtraction_7, eval_20, addition, filter_lpp1_of_lpp2])
pdecon_19 = Deconstruct(Point=pt_max_xyz_of_bbox_of_bare_hull)  # -> XComponent, expr("-X", YComponent), ZComponent
pt2num_21 = PointsToNumbers(Points=box_corners_8.CornerD, Mask=11)
item_10 = ListItem(List=xstern_startmidship_startforeship_lpp, Index=0, Wrap=True)
item_11 = ListItem(List=xstern_startmidship_startforeship_lpp, Index=1, Wrap=True)
pt_12 = ConstructPoint(
    XCoordinate=expr("X+1000", pdecon_19.XComponent),
    YCoordinate=expr("1.1*x", pdecon_19.YComponent),
    ZCoordinate=expr("x+1000", pdecon_19.ZComponent))
pt_13 = ConstructPoint(XCoordinate=expr("x-1000", item_10), YCoordinate=0, ZCoordinate=pt2num_21)
box_4 = Box2Pt(PointA=pt_13, PointB=pt_12, Plane=PlaneXY(0, 0, 0))

# ---- group: Only buoyant calculation
toggle_show_at_least_the_buoyant_volume = BooleanToggle(True)
sift_11 = SiftPattern(List=sift_10.Output0, SiftPattern=toggle_show_at_least_the_buoyant_volume)  # -> Output0, Output1
sint_3 = SolidIntersection(BrepsA=sint, BrepsB=sift_11.Output1)
sint_4 = SolidIntersection(BrepsA=rotate_4.Geometry, SolidHull=sint_3)

# ----
# Half solid of under water hull
# Right click on the above.
# Choose "Bake".
# Select the layer to bake in
sint_5 = SolidIntersection(BrepsA=rotate_4.Geometry, SolidHull=sint_2)
combine_3 = CombineData(Input0=sint_5, Input1=sint_4)  # -> Result, Index

# ----
# Note: A half hull requires less computational time
# Half solid of
# whole, aft, mid and fore ship
sift_12 = SiftPattern(List=box_4, SiftPattern=bool_volume_related_output)  # -> Output0, Output1
# Whole hull
sint_6 = SolidIntersection(BrepsA=sift_12.Output1, SolidHull=sint_2)

# ---- group: Carene Volume
# Buoyancy volume
# or Carene Volume
# Whole hull
volume = Volume(Geometry=combine_3.Result)  # -> Volume, COBHalfHull

# ---- group: Volume of selection
# Volume and .....
# Whole hull
volume_2 = Volume(Geometry=sint_6)  # -> expr("x*2", Volume), COVHalfHull

# ----
# Cb by Lwl and Lpp
division_18 = Division(A=volume.Volume, LBT=eval_29)
division_19 = Division(A=volume.Volume, B=eval_30)

# ---- group: BoundingBox data of selections
bbox_8 = BoundingBox(Content=sint_5, Plane=PlaneXY(0, 0, 0))  # -> Box, Box_2
bbox_9 = BoundingBox(Content=sint_6, Plane=PlaneXY(0, 0, 0))  # -> Box, Box_2
box_corners_9 = BoxCorners(Box=bbox_8.Box)  # -> AMinXYZ, flatten(CornerB), CornerC, CornerD, CornerE, CornerF, GMaxXYZ, CornerH
box_corners_10 = BoxCorners(Box=bbox_9.Box)  # -> AMinXYZ, flatten(CornerB), CornerC, CornerD, CornerE, CornerF, GMaxXYZ, CornerH
dist_3 = Distance(PointA=box_corners_9.AMinXYZ, PointB=box_corners_9.CornerB)
pt2num_22 = PointsToNumbers(Points=[box_corners_9.AMinXYZ, box_corners_9.GMaxXYZ], Mask=1)
pt2num_23 = PointsToNumbers(Points=[box_corners_10.AMinXYZ, box_corners_10.GMaxXYZ], Mask=1)  # -> flatten(Numbers)

# ----
dist_4 = Distance(PointA=box_corners_10.AMinXYZ, PointB=box_corners_10.CornerB)
sift_13 = SiftPattern(List=sint_5, SiftPattern=and_2)  # -> Output0, Output1

# ---- group: X division method 1: evenly devided
number_of_segments_21_22_ordinates = Integer(21)
ln_5 = Line(StartPoint=box_corners_10.AMinXYZ, EndPoint=box_corners_10.CornerB)
ln_6 = Line(StartPoint=box_corners_9.AMinXYZ, EndPoint=box_corners_9.CornerB)
frm_4 = PerpFrames(Curve=ln_6, Number=number_of_segments_21_22_ordinates, Align=True)  # -> Frames, Parameters
frm_5 = PerpFrames(Curve=ln_5, Number=number_of_segments_21_22_ordinates, Align=True)  # -> Frames, Parameters

# ----
half_solid_of_under_water_hull = Brep(sint_5)

# ---- group: Centre of Buoyancy
pdecon_20 = Deconstruct(Point=volume.COBHalfHull)  # -> XComponent, YComponent, ZComponent
pt_14 = ConstructPoint(XCoordinate=pdecon_20.XComponent, YCoordinate=0, ZCoordinate=pdecon_20.ZComponent)

# ----
sift_14 = SiftPattern(List=pt_14, SiftPattern=button_show_centers)  # -> Output0, Output1

# ---- group: Centre of Buoyancy (continued)
line_7 = LineSDL(Start=sift_14.Output1, Direction=Vector(1196.036814, 0, 1196.036814), Length=expr("x*2", eval_10))
markdim_2 = MarkerDimension(Line=line_7, Text="  COB whole ship", Size=eval_10)

# ---- group: Centre of volume
# Centre of Volume
pdecon_21 = Deconstruct(Point=volume_2.COVHalfHull)  # -> XComponent, YComponent, ZComponent
eval_45 = Evaluate(
    F="Format(\"2. COV_whole_ship_xyz {0:0.000}, {1:0.000}, {2:0.000} m\", x/1000, 0, z/1000)",
    x=pdecon_21.XComponent,
    y=pdecon_21.YComponent,
    z=pdecon_21.ZComponent)
pt_15 = ConstructPoint(XCoordinate=pdecon_21.XComponent, YCoordinate=0, ZCoordinate=pdecon_21.ZComponent)
panel_25 = Panel(eval_45)

# ----
sift_15 = SiftPattern(List=pt_15, SiftPattern=button_show_centers)  # -> Output0, Output1

# ---- group: Centre of volume (continued)
line_8 = LineSDL(Start=sift_15.Output1, Direction=Vector(1196.036814, 0, 1196.036814), Length=expr("x*2", eval_10))
markdim_3 = MarkerDimension(Line=line_8, Text="  COV whole ship", Size=eval_10)

# ----
eval_46 = Evaluate(F="round(x/(y^3),3)", x=volume.Volume, y=output_dimension)
eval_47 = Evaluate(F="round(x/(y^1),3)", x=pt_15, y=output_dimension)
eval_48 = Evaluate(F="round(x/(y^3),3)", x=volume_2.Volume, y=output_dimension)
eval_49 = Evaluate(F="round(x,4)", x=division_19, y=output_dimension)
eval_50 = Evaluate(F="round(x,4)", x=division_18, y=output_dimension)
eval_51 = Evaluate(F="round(x/(y^1),3)", x=pt_14, y=output_dimension)
panel_26 = Panel("""Buoyant Volume 
Total Volume 
COB 
COV Total 
Cb_pp 
Cb_wl  """)
merge_8 = Merge(
    Data1=flatten(eval_46),
    Data2=flatten(eval_48),
    Data3=flatten(eval_51),
    Data4=flatten(eval_47),
    Data5=flatten(eval_50),
    Data6=flatten(eval_49))  # -> flatten(Result)
rep_4 = ReplaceText(Text=merge_8, Find="{", RecursiveReplace=False)
panel_27 = Panel("""m3
m3
m
m
-
-""")
rep_5 = ReplaceText(Text=rep_4, Find="}", RecursiveReplace=False)
rep_6 = ReplaceText(Text=panel_27, Find="m", Replace=eval_14, RecursiveReplace=False)
case_3 = TextCase(Text="Volume Related Data (moulded)", Culture=127)  # -> UpperCase, LowerCase
concat_14 = Concatenate(FragmentB=panel_26, FragmentA="[", FragmentC=rep_6, FragmentD="],")
concat_15 = Concatenate(FragmentB=case_3.UpperCase)
concat_16 = Concatenate(FragmentA=concat_14, FragmentB=rep_5)
concat_17 = Concatenate(FragmentA=panel_26, FragmentB=rep_5, FragmentC=" ", FragmentD=rep_6)
volume_data = Panel([concat_15, concat_16])
volume_data_2 = Panel([case_3.UpperCase, concat_17])

# ---- group: Deconstruct all hull surfaces of underwaterhull
# Wet Hull Surfaces
sift_16 = SiftPattern(List=sint_5, SiftPattern=bool_volume_related_output)  # -> Output0, Output1
debrep_3 = DeconstructBrep(Brep=sift_16.Output1)  # -> flatten(Faces), Edges, Vertices
boxprop_6 = BoxProperties(Box=debrep_3.Faces)  # -> Center, Diagonal, Area, Volume, Degeneracy
show_underwater_areas_blue_waterplane_wh = BooleanToggle(False)  # "Show underwater areas (blue=waterplane, white=shell, red=transom)"

# ---- group: checks if the mirror has a point below the waterline
pcx_4 = CurvePlane(Curve=move_15.Geometry, Plane=Plane(origin=(0, 0, 0), x=(0, 0, 1), y=(1, 0, 0)))  # -> Points, ParamsC, ParamsP
t_moulded = Number(eval_16)
tmirror = Number(eval_25)
pt2num_24 = PointsToNumbers(Points=pcx_4.Points, Mask=11)
smaller_2 = SmallerThan(FirstNumber=pt2num_24, SecondNumber=tmirror)  # -> SmallerThan, OrEqualTo
sift_17 = SiftPattern(List=debrep_3.Faces, SiftPattern=smaller_2.SmallerThan)  # -> Output0, Output1

# ----
sift_18 = SiftPattern(List=boxprop_6.Center, SiftPattern=smaller_2.SmallerThan)  # -> Output0, Output1

# ---- group: selects non planar surfaces (shell ps&sb)
planar = IsPlanar(Surface=debrep_3.Faces, Interior=True)  # -> Planar, Plane
sift_19 = SiftPattern(List=debrep_3.Faces, SiftPattern=planar.Planar)  # -> Output0, Output1
null_2 = NullItem(Item=sift_19.Output0)  # -> NullFlags, InvalidFlags, Description
dispatch_6 = Dispatch(List=sift_19.Output0, DispatchPattern=null_2.NullFlags)  # -> ListA, ListB
join_7 = BrepJoin(Breps=dispatch_6.ListB)  # -> Breps, Closed

# ---- group: checks which box-centerpoint is closest the waterplane
pxs_5 = PlaneThroughShape(Plane=rotate_2.Geometry, Shape=join_4.Breps, Inflate=1, SectionLogic=False)
srf_cp = SurfaceClosestPoint(Point=boxprop_6.Center, Surface=pxs_5)  # -> Point, UVPoint, Distance
sort_7 = SortList(Keys=srf_cp.Distance, ValuesA=debrep_3.Faces)  # -> Keys, ValuesA
item_12 = ListItem(List=sort_7.ValuesA, Index=0, Wrap=True)

# ---- group: checks wich box-centerpoint is closest to the transom plane
planar_2 = Planar(Curve=move_15.Geometry)  # -> Planar, Plane, Deviation
pxs_6 = PlaneThroughShape(Plane=planar_2.Plane, Shape=join_4.Breps, Inflate=1, SectionLogic=False)
srf_cp_2 = SurfaceClosestPoint(Point=sift_18.Output1, Surface=pxs_6)  # -> Point, UVPoint, Distance
sort_8 = SortList(Keys=srf_cp_2.Distance, ValuesA=sift_17.Output1)  # -> Keys, ValuesA
item_13 = ListItem(List=sort_8.ValuesA, Index=0, Wrap=True)

# ----
sift_20 = SiftPattern(List=dispatch_6.ListB, SiftPattern=show_underwater_areas_blue_waterplane_wh)  # -> Output0, Output1

# ---- group: Deconstruct all hull surfaces of underwaterhull
# Hull Surfaces
sift_21 = SiftPattern(List=sint_6, SiftPattern=bool_volume_related_output)  # -> Output0, Output1; disabled
debrep_4 = DeconstructBrep(Brep=sift_21.Output1)  # -> flatten(Faces), Edges, Vertices; disabled
boxprop_7 = BoxProperties(Box=debrep_4.Faces)  # -> Center, Diagonal, Area, Volume, Degeneracy; disabled
show_areas_blue_deck_white_shell_red_tra = BooleanToggle(False)  # "Show areas (blue=deck, white=shell, red=transom)"; disabled
swatch = ColourSwatch(SwatchColor=RGBA(0, 93, 255, 71))  # disabled
swatch_2 = ColourSwatch(SwatchColor=RGBA(255, 0, 0, 81))  # disabled
swatch_3 = ColourSwatch(SwatchColor=RGBA(255, 255, 255, 35))  # disabled

# ---- group: checks if the mirror has a point below the waterline
pcx_5 = CurvePlane(Curve=move_15.Geometry, Plane=Plane(origin=(0, 0, 0), x=(0, 0, 1), y=(1, 0, 0)))  # -> Points, ParamsC, ParamsP; disabled
t_moulded_2 = Number(eval_16)  # disabled
tmirror_2 = Number(eval_25)  # disabled
pt2num_25 = PointsToNumbers(Points=pcx_5.Points, Mask=11)  # disabled
smaller_3 = SmallerThan(FirstNumber=pt2num_25, SecondNumber=depth)  # -> SmallerThan, OrEqualTo; disabled
sift_22 = SiftPattern(List=debrep_4.Faces, SiftPattern=smaller_3.SmallerThan)  # -> Output0, Output1; disabled

# ----
sift_23 = SiftPattern(List=boxprop_7.Center, SiftPattern=smaller_3.SmallerThan)  # -> Output0, Output1; disabled

# ---- group: selects non planar surfaces (shell ps&sb)
planar_3 = IsPlanar(Surface=debrep_4.Faces, Interior=True)  # -> Planar, Plane; disabled
sift_24 = SiftPattern(List=debrep_4.Faces, SiftPattern=planar_3.Planar)  # -> Output0, Output1; disabled
null_3 = NullItem(Item=sift_24.Output0)  # -> NullFlags, InvalidFlags, Description; disabled
dispatch_7 = Dispatch(List=sift_24.Output0, DispatchPattern=null_3.NullFlags)  # -> ListA, ListB; disabled
join_8 = BrepJoin(Breps=dispatch_7.ListB)  # -> Breps, Closed; disabled

# ---- group: checks which box-centerpoint is closest the waterplane
pxs_7 = PlaneThroughShape(Plane=xy_2, Shape=join_4.Breps, Inflate=1, SectionLogic=False)  # disabled
srf_cp_3 = SurfaceClosestPoint(Point=boxprop_7.Center, Surface=pxs_7)  # -> Point, UVPoint, Distance; disabled
sort_9 = SortList(Keys=srf_cp_3.Distance, ValuesA=debrep_4.Faces)  # -> Keys, ValuesA; disabled
item_14 = ListItem(List=sort_9.ValuesA, Index=0, Wrap=True)  # disabled

# ---- group: checks wich box-centerpoint is closest to the transom plane
planar_4 = Planar(Curve=move_15.Geometry)  # -> Planar, Plane, Deviation; disabled
pxs_8 = PlaneThroughShape(Plane=planar_4.Plane, Shape=join_4.Breps, Inflate=1, SectionLogic=False)  # disabled
srf_cp_4 = SurfaceClosestPoint(Point=sift_23.Output1, Surface=pxs_8)  # -> Point, UVPoint, Distance; disabled
sort_10 = SortList(Keys=srf_cp_4.Distance, ValuesA=sift_22.Output1)  # -> Keys, ValuesA; disabled
item_15 = ListItem(List=sort_10.ValuesA, Index=0, Wrap=True)  # disabled

# ----
offset = OffsetSurface(Surface=join_8.Breps, Distance=eval_8, Retrim=True)  # disabled
sift_25 = SiftPattern(List=dispatch_7.ListB, SiftPattern=show_areas_blue_deck_white_shell_red_tra)  # -> Output0, Output1; disabled

# ---- group: Data Waterballast tank
# Volume of fwd ballasttank
# Finds the water plane surface by the closest point
# to the water plane
pt2num_26 = PointsToNumbers(Points=box_corners_10.AMinXYZ, Mask=1)
loa = Number(dist_4)
eval_52 = Evaluate(F="Loa*y/100", Loa=loa, y=position_of_tank_bhd_in_of_loa)
num_xmin = Number(pt2num_26)
eval_53 = Evaluate(F="Dm*y/100", Dm=eval_17, y=fillingheight_of_tank_in_of_dm)
addition_4 = Addition(A=num_xmin, B=eval_52)
Z_5 = UnitZ(Factor=eval_53)
sift_26 = SiftPattern(List=sint_2, SiftPattern=and)  # -> Output0, Output1
X_14 = UnitX(Factor=addition_4)
xy_7 = XYPlane(Origin=Z_5)
yz_4 = YZPlane(Origin=X_14)
pxs_9 = PlaneThroughShape(Plane=yz_4, Shape=sift_26.Output1, Inflate=1, SectionLogic=False)
split_8 = SplitBrep(Brep=sift_26.Output1, Cutter=pxs_9)
boxprop_8 = BoxProperties(Box=split_8)  # -> Center, Diagonal, Area, Volume, Degeneracy
pt2num_27 = PointsToNumbers(Points=boxprop_8.Center, Mask=1)
sort_11 = SortList(Keys=pt2num_27, ValuesA=split_8)  # -> Keys, ValuesA
item_16 = ListItem(List=sort_11.ValuesA, Index=-1, Wrap=True)
cap_2 = CapHoles(Brep=item_16)
swatch_4 = ColourSwatch(SwatchColor=RGB(0, 187, 255))

# ---- group: X division method 2: creates the division over the length of all cross sectional tables and curves including Xstern, X_app, Xwl_aft, XstartMidship, XstartForeship, Xbhd_tank, Xwl_fwd, Xfpp, Xfwd_oa
x_app = Integer(0)
sort_12 = SortList(Keys=flatten([subtraction_7, eval_20, addition, filter_lpp1_of_lpp2, pt2num_23, pt2num_22, x_app, addition_4]))  # -> Keys, ValuesA
num2pt = NumbersToPoints(Numbers=sort_12.Keys, Mask=1)
cullpt = CullDuplicates(Points=num2pt, Tolerance=0.1, CullMode=3)  # -> Points, Indices, Valence
shift = ShiftList(List=cullpt.Points, Shift=1, Wrap=False)
weave = Weave(Pattern=[0, 1], Stream0=graft(cullpt.Points), Stream1=graft(shift), NullGaps=False)
xstern_x_app_xwl_aft_xstartmidship_xstar = Panel(cullpt.Points)  # "Xstern, X_app, Xwl_aft, XstartMidship, XstartForeship, Xbhd_tank, Xwl_fwd, Xfpp, Xfwd_oa"
item_17 = ListItem(List=weave, Index=0, Wrap=True)  # -> Item, Item1
ln_7 = Line(StartPoint=item_17.Item, EndPoint=item_17.Item1)
len = Length(Curve=ln_7)
number_slider = Slider(4, range=2..24)
larger_2 = LargerThan(FirstNumber=len, SecondNumber=expr("x/4", filter_lpp1_of_lpp2))  # -> LargerThan, OrEqualTo
eval_54 = Evaluate(F="IF(x=FALSE,y,y*2)", x=larger_2.LargerThan, y=number_slider)
frm_6 = PerpFrames(Curve=ln_7, Number=eval_54, Align=True)  # -> flatten(Frames), Parameters
cullpt_2 = CullDuplicates(Points=frm_6.Frames, Tolerance=0.1, CullMode=3)  # -> flatten(Points), Indices, Valence
yz_5 = YZPlane(Origin=cullpt_2.Points)

# ---- group: Data Waterballast tank / waterplane tank at no even keel
pxs_10 = PlaneThroughShape(Plane=xy_7, Shape=cap_2, Inflate=1, SectionLogic=False)
sec_4 = BrepPlane(Brep=cap_2, Plane=pxs_10)  # -> Curves, Points
boundary_2 = BoundarySurfaces(Edges=sec_4.Curves)
area_15 = Area(Geometry=boundary_2)  # -> Area, Centroid

# ---- group: Data Waterballast tank / Waterline with trim and heel
yz_6 = YZPlane(Origin=area_15.Centroid)
rotate_5 = Rotate(Geometry=xy_7, Angle=rad, Plane=yz_6)  # -> Geometry, Transform
xz_3 = XZPlane(Origin=area_15.Centroid)
rotate_6 = Rotate(Geometry=rotate_5.Geometry, Angle=rad_2, Plane=xz_3)  # -> Geometry, Transform

# ---- group: Data Waterballast tank (continued)
pxs_11 = PlaneThroughShape(Plane=rotate_6.Geometry, Shape=cap_2, Inflate=1, SectionLogic=False)
split_9 = SplitBrep(Brep=cap_2, Cutter=pxs_11)
boxprop_9 = BoxProperties(Box=split_9)  # -> Center, Diagonal, Area, Volume, Degeneracy
pt2num_28 = PointsToNumbers(Points=boxprop_9.Center, Mask=11)
sort_13 = SortList(Keys=pt2num_28, ValuesA=split_9, ValuesB=boxprop_9.Diagonal)  # -> Keys, ValuesA, ValuesB
item_18 = ListItem(List=sort_13.ValuesA, Index=0, Wrap=True)
cap_3 = CapHoles(Brep=item_18)
volume_3 = Volume(Geometry=cap_3)  # -> Volume, Centroid
preview_9 = CustomPreview(Geometry=cap_3, Material=ColourSwatch(SwatchColor=RGBA(0, 187, 255, 99)))
debrep_5 = DeconstructBrep(Brep=cap_3)  # -> flatten(Faces), Edges, Vertices
boxprop_10 = BoxProperties(Box=debrep_5.Faces)  # -> Center, Diagonal, Area, Volume, Degeneracy
srf_cp_5 = SurfaceClosestPoint(Point=flatten(boxprop_10.Center), Surface=pxs_11)  # -> Point, UVPoint, Distance
sort_14 = SortList(Keys=srf_cp_5.Distance, ValuesA=debrep_5.Faces)  # -> Keys, ValuesA
item_19 = ListItem(List=sort_14.ValuesA, Index=0, Wrap=True)
amoments = AreaMoments(Geometry=item_19)  # -> Area, Centroid, Inertia, InertiaError, Secondary, SecondaryError, Gyration

# ---- group: selection of X division method
x_division_method_2 = Integer(x_division_method)
filter_3 = StreamFilter(Gate=x_division_method_2, Stream1=frm_4.Frames, Stream2=yz_5)
filter_4 = StreamFilter(Gate=x_division_method_2, Stream1=frm_5.Frames, Stream2=yz_5)

# ----
sift_27 = SiftPattern(List=filter_4, SiftPattern=bool_volume_related_output)  # -> Output0, Output1
sift_28 = SiftPattern(List=filter_3, SiftPattern=bool_volume_related_output)  # -> Output0, Output1

# ---- group: Creation of frames for cross sectional areas
lng_3 = ListLength(List=sift_27.Output1)  # -> expr("x-1", Length)
sec_frames_2 = BrepPlane(Brep=sift_13.Output1, Plane=sift_28.Output1)  # -> Curves, Points
item_20 = ListItem(List=sift_27.Output1, Index=lng_3, Wrap=True)
sift_29 = SiftPattern(List=sint_2, SiftPattern=toggle_cross_area_curves)  # -> Output0, Output1
pt2num_29 = PointsToNumbers(Points=item_20, Mask=1)
sec_frames_3 = BrepPlane(Brep=sift_29.Output1, Plane=sift_27.Output1)  # -> Curves, Points
pt_16 = ConstructPoint(XCoordinate=expr("x-1", pt2num_29), YCoordinate=0, ZCoordinate=0)

# ----
eval_55 = Evaluate(F="round(x/(y^3),3)", x=volume_3.Volume, y=output_dimension)
eval_56 = Evaluate(F="round(x/(y^1),3)", x=volume_3.Centroid, y=output_dimension)
eval_57 = Evaluate(F="round(x/(y^1),3)", x=addition_4, y=output_dimension)
eval_58 = Evaluate(F="round(x/(y^2),3)", x=amoments.Area, y=output_dimension)
eval_59 = Evaluate(F="round(x/(y^4),3)", x=amoments.Inertia, y=output_dimension)
eval_60 = Evaluate(F="round(x/(y^1),3)", x=amoments.Centroid, y=output_dimension)
panel_28 = Panel("""Volume water ballast 
COV WB 
Position of tank BHD 
Height of WB 
Area WB plane 
COA WB plane 
Inertia WB plane """)
merge_9 = Merge(
    Data1=flatten(eval_55),
    Data2=flatten(eval_56),
    Data3=flatten(eval_57),
    Data4=flatten(fillingheight_of_tank_in_of_dm),
    Data5=flatten(eval_58),
    Data6=flatten(eval_60),
    Data7=flatten(eval_59))  # -> flatten(Result)
rep_7 = ReplaceText(Text=merge_9, Find="{", RecursiveReplace=False)
panel_29 = Panel("""m3
m
m
% of D
m2
m
m4""")
rep_8 = ReplaceText(Text=rep_7, Find="}", RecursiveReplace=False)
rep_9 = ReplaceText(Text=panel_29, Find="m", Replace=eval_14, RecursiveReplace=False)
case_4 = TextCase(Text="Fore Peak Tank (Ballast water)", Culture=127)  # -> UpperCase, LowerCase
concat_18 = Concatenate(FragmentB=panel_28, FragmentA="[", FragmentC=rep_9, FragmentD="],")
concat_19 = Concatenate(FragmentB=case_4.UpperCase)
concat_20 = Concatenate(FragmentA=concat_18, FragmentB=rep_8)
concat_21 = Concatenate(FragmentA=panel_28, FragmentB=rep_8, FragmentC=" ", FragmentD=rep_9)
volume_data_ballast_water_tank = Panel([concat_19, concat_20])
volume_data_ballast_water_tank_2 = Panel([case_4.UpperCase, concat_21])

# ---- group: Deconstruct all hull surfaces of underwaterhull (continued)
brep_deck = Brep(item_14)  # disabled
brep_transom = Brep(item_15)  # disabled
area_16 = Area(Geometry=brep_transom)  # -> Area, Centroid; disabled
null_4 = NullItem(Item=area_16.Area)  # -> NullFlags, InvalidFlags, Description; disabled
area_17 = Area(Geometry=join_8.Breps)  # -> Area, Centroid; disabled
join_9 = BrepJoin(Breps=sift_25.Output1)  # -> Breps, Closed; disabled
p_n_c = PickNChoose(Pattern=null_4.NullFlags, Stream0=area_16.Area, Stream1=0)  # disabled
preview_10 = CustomPreview(Geometry=join_9.Breps, Shader=swatch_3)  # disabled

# ----
sift_30 = SiftPattern(List=brep_transom, SiftPattern=show_areas_blue_deck_white_shell_red_tra)  # -> Output0, Output1; disabled
sift_31 = SiftPattern(List=brep_deck, SiftPattern=show_areas_blue_deck_white_shell_red_tra)  # -> Output0, Output1; disabled

# ---- group: Deconstruct all hull surfaces of underwaterhull (continued)
preview_11 = CustomPreview(Geometry=sift_31.Output1, Shader=swatch)  # disabled
preview_12 = CustomPreview(Geometry=sift_30.Output1, Shader=swatch_2)  # disabled

brep_wet_transom_only_if_out_one_peace = Brep(item_13)
brep_waterplane = Brep(item_12)
area_18 = Area(Geometry=brep_wet_transom_only_if_out_one_peace)  # -> Area, Centroid
null_5 = NullItem(Item=area_18.Area)  # -> NullFlags, InvalidFlags, Description
area_19 = Area(Geometry=join_7.Breps)  # -> Area, Centroid
join_10 = BrepJoin(Breps=sift_20.Output1)  # -> Breps, Closed
p_n_c_2 = PickNChoose(Pattern=null_5.NullFlags, Stream0=area_18.Area, Stream1=0)
preview_13 = CustomPreview(Geometry=join_10.Breps, Shader=ColourSwatch(SwatchColor=RGBA(255, 255, 255, 35)))

# ----
sift_32 = SiftPattern(List=brep_wet_transom_only_if_out_one_peace, SiftPattern=show_underwater_areas_blue_waterplane_wh)  # -> Output0, Output1
sift_33 = SiftPattern(List=brep_waterplane, SiftPattern=show_underwater_areas_blue_waterplane_wh)  # -> Output0, Output1

# ---- group: Deconstruct all hull surfaces of underwaterhull (continued)
preview_14 = CustomPreview(Geometry=sift_33.Output1, Shader=ColourSwatch(SwatchColor=RGBA(0, 93, 255, 71)))
preview_15 = CustomPreview(Geometry=sift_32.Output1, Shader=ColourSwatch(SwatchColor=RGBA(255, 0, 0, 81)))

# ----
# Determine waterline moment of inertia
amoments_2 = AreaMoments(Geometry=brep_waterplane)  # -> Area, Centroid, Inertia, InertiaError, Secondary, SecondaryError, Gyration

# ----
# Holtrop & Mennen resistance prediction
panel_30 = Panel("""1. 
2. 
3. 
4. 
5. 
6. 
7. 
8. 
9. 
10. 
11. 
12. """)
panel_31 = Panel("""Lwl
B
T_loading
Displ_m
Am
Awp
COB
S
IE
At
Ta
Tf""")
division_20 = Division(A=pdecon_20.XComponent, B=1000)
displ_moulded = Number(volume.Volume)
tf = Number(eval_27)
doa = Number(eval_5)
ta = Number(eval_26)
lwl = Number(dist)
ie = Number(eval_44)
at = Number(p_n_c_2)
S = Number(area_19.Area)
t_loading = Number(eval_16)
awp = Number(amoments_2.Area)
cob = Data(division_20)
B = Number(eval_18)
subtraction_12 = Subtraction(A=doa, B=ta)
larger_3 = LargerThan(FirstNumber=ta, SecondNumber=doa)  # -> LargerThan, OrEqualTo
subtraction_13 = Subtraction(A=doa, B=tf)
larger_4 = LargerThan(FirstNumber=tf, SecondNumber=doa)  # -> LargerThan, OrEqualTo
or = GateOr(A=larger_3.LargerThan, B=larger_4.LargerThan)
min_2 = Minimum(A=subtraction_12, B=subtraction_13)
and_4 = GateAnd(A=toggle_holtrop_mennen_prediction, B=toggle_volume_related_output)
eval_61 = Evaluate(F="IF(x=TRUE,\"Deck is submerged\",\"Deck is \"&round(y,2)&\" mm from WL\")", x=or, y=min_2)
panel_32 = Panel(eval_61)
nullrep = ReplaceNulls(Items=ie, Replacements=0)  # -> Items, Count
eval_62 = Evaluate(F="(x-6)/(1/z)", x=design_speed_kn, z=steps_per_knot_kn)
panel_33 = Panel("RESISTANCE ESTIMATION BY METHOD HOLTROP & MENNEN 1982 & 1984")
panel_34 = Panel("V [kn], V [m/s], Fn,  Rtot [N], R_visc [N], R_app [N], R_w [N], R_TR [N], R_b [N], R_A [N], R_BTO [N], w[-], t[-]")

# ---- group: Curves of Cross sectional areas
# Curves of cross sectional areas
# Sums the  two areas
# (in case of a bulb)
# Set a value of 0 at empty lists
# Sums the  two areas
# (in case of a bulb)
scale_kvs = Slider(16203, range=1..20000)
scale_8 = Number(combine.Result)
cir = Circle(Plane=PlaneYZ(0, 0, 0), Radius=10000)
flip_4 = FlipCurve(Curve=sec_frames_3.Curves, Guide=cir)  # -> Curve, Flag
flip_5 = FlipCurve(Curve=sec_frames_2.Curves, Guide=cir)  # -> Curve, Flag
boundary_3 = BoundarySurfaces(Edges=simplify(flip_5.Curve))
boundary_4 = BoundarySurfaces(Edges=flip_4.Curve)
swatch_5 = ColourSwatch(SwatchColor=RGBA(0, 0, 150, 147))
swatch_6 = ColourSwatch(SwatchColor=RGB(0, 116, 255))
area_20 = Area(Geometry=boundary_4)  # -> Area, Centroid
area_21 = Area(Geometry=boundary_3)  # -> Area, Centroid
null_6 = NullItem(Item=area_21.Area)  # -> NullFlags, InvalidFlags, Description
lng_4 = ListLength(List=area_21.Area)
p_n_c_3 = PickNChoose(Pattern=null_6.NullFlags, Stream0=area_21.Area, Stream1=lng_4)
null_7 = NullItem(Item=area_20.Area)  # -> NullFlags, InvalidFlags, Description
lng_5 = ListLength(List=area_20.Area)
p_n_c_4 = PickNChoose(Pattern=null_7.NullFlags, Stream0=area_20.Area, Stream1=lng_5)
dispatch_8 = Dispatch(List=p_n_c_3, DispatchPattern=[True, False])  # -> ListA, ListB
dispatch_9 = Dispatch(List=p_n_c_4, DispatchPattern=[True, False])  # -> ListA, ListB
addition_5 = Addition(A=dispatch_9.ListA, B=dispatch_9.ListB)  # -> flatten(Result)
addition_6 = Addition(A=dispatch_8.ListA, B=dispatch_8.ListB)  # -> flatten(Result)
division_21 = Division(A=scale_kvs, B=scale_8)
division_22 = Division(A=scale_kvs, B=scale_8)
division_23 = Division(A=addition_5, B=division_21)
division_24 = Division(A=addition_6, B=division_22)
pt_17 = PointOriented(FramePoints=sift_27.Output1, UComponent=0, VComponent=0, WComponent=0)
pt_18 = PointOriented(FramePoints=sift_28.Output1, UComponent=0, VComponent=0, WComponent=0)
pt2num_30 = PointsToNumbers(Points=pt_17, Mask=1)
pt2num_31 = PointsToNumbers(Points=pt_18, Mask=1)
pt_19 = ConstructPoint(XCoordinate=pt2num_30, YCoordinate=0, ZCoordinate=0)
pt_20 = ConstructPoint(XCoordinate=pt2num_31, YCoordinate=0, ZCoordinate=0)
line_9 = LineSDL(Start=pt_20, Direction=Vector(0, 0, -1), Length=flatten(division_24))
line_10 = LineSDL(Start=pt_19, Direction=Vector(0, 0, -1), Length=flatten(division_23))
end_12 = EndPoints(Curve=line_9)  # -> Start, flatten(End)
end_13 = EndPoints(Curve=line_10)  # -> Start, flatten(End)
intcrv = Interpolate(Vertices=end_13.End, Degree=3, Periodic=False, KnotStyle=1)  # -> Curve, Length, Domain
intcrv_2 = Interpolate(Vertices=end_12.End, Degree=3, Periodic=False, KnotStyle=1)  # -> Curve, Length, Domain
end_14 = EndPoints(Curve=intcrv.Curve)  # -> Start, End
end_15 = EndPoints(Curve=intcrv_2.Curve)  # -> Start, End
midpt_3 = CurveMiddle(Curve=intcrv.Curve)
pt2num_32 = PointsToNumbers(Points=end_14.Start, Mask=1)
pt2num_33 = PointsToNumbers(Points=end_14.End, Mask=1)
pt2num_34 = PointsToNumbers(Points=end_15.Start, Mask=1)
pt2num_35 = PointsToNumbers(Points=end_15.End, Mask=1)
midpt_4 = CurveMiddle(Curve=intcrv_2.Curve)
num2pt_2 = NumbersToPoints(Numbers=pt2num_32, Mask=1)
num2pt_3 = NumbersToPoints(Numbers=pt2num_33, Mask=1)
num2pt_4 = NumbersToPoints(Numbers=pt2num_34, Mask=1)
num2pt_5 = NumbersToPoints(Numbers=pt2num_35, Mask=1)
xz_4 = XZPlane(Origin=midpt_3)
xz_5 = XZPlane(Origin=midpt_4)
ln_8 = Line(StartPoint=num2pt_2, EndPoint=num2pt_3)
T = Text("Total Cross Section Areas")
ln_9 = Line(StartPoint=num2pt_4, EndPoint=num2pt_5)
join_11 = JoinCurves(Curves=[intcrv.Curve, ln_8], Preserve=False)
join_12 = JoinCurves(Curves=[intcrv_2.Curve, ln_9], Preserve=False)
T_2 = Text("Buoyant Cross Section Areas")
preview_16 = CustomPreview(Geometry=[join_12, line_9], Shader=swatch_5)
preview_17 = CustomPreview(Geometry=[join_11, line_10], Shader=swatch_6)

# ---- group: Curves of cross section areas of ballast tank filling
# Sums the  two areas
# (in case of a bulb)
# Set a value of 0 at empty lists
# Number of section of ballast tank based on Lpp/3
# Manual number of sections of ballast tank (Manual if Z > 0)
pt2num_36 = PointsToNumbers(Points=sort_13.ValuesB, Mask=1)
int_z = Slider(0, range=0..10)
item_21 = ListItem(List=pt2num_36, Index=0, Wrap=True)
larger_5 = LargerThan(FirstNumber=item_21, SecondNumber=expr("x/3", filter_lpp1_of_lpp2))  # -> LargerThan, OrEqualTo
line_11 = LineSDL(Start=X_14, Direction=Vector(1, 0, 0), Length=item_21)
eval_63 = Evaluate(F="IF(z>0,z,IF(x=FALSE,y,y*2))", x=larger_5.LargerThan, y=number_slider, z=int_z)
frm_7 = PerpFrames(Curve=line_11, Number=eval_63, Align=True)  # -> flatten(Frames), Parameters
cullpt_3 = CullDuplicates(Points=frm_7.Frames, Tolerance=0.1, CullMode=3)  # -> flatten(Points), Indices, Valence
yz_7 = YZPlane(Origin=cullpt_3.Points)
sec_frames_4 = BrepPlane(Brep=cap_3, Plane=yz_7)  # -> Curves, Points
flip_6 = FlipCurve(Curve=sec_frames_4.Curves, Guide=cir)  # -> Curve, Flag
boundary_5 = BoundarySurfaces(Edges=simplify(flip_6.Curve))
sift_34 = SiftPattern(List=boundary_5, SiftPattern=button_show_cross_sections)  # -> Output0, Output1
area_22 = Area(Geometry=boundary_5)  # -> expr("x*1", Area), Centroid
null_8 = NullItem(Item=area_22.Area)  # -> NullFlags, InvalidFlags, Description
lng_6 = ListLength(List=area_22.Area)
preview_18 = CustomPreview(Geometry=sift_34.Output1, Material=swatch_4)
p_n_c_5 = PickNChoose(Pattern=null_8.NullFlags, Stream0=area_22.Area, Stream1=lng_6)
dispatch_10 = Dispatch(List=p_n_c_5, DispatchPattern=[True, False])  # -> ListA, ListB
addition_7 = Addition(A=dispatch_10.ListA, B=dispatch_10.ListB)  # -> flatten(Result)
division_25 = Division(A=scale_kvs, B=scale_8)
division_26 = Division(A=addition_7, B=division_25)
pt_21 = PointOriented(FramePoints=cullpt_3.Points, UComponent=0, VComponent=0, WComponent=0)
pt2num_37 = PointsToNumbers(Points=pt_21, Mask=1)
pt_22 = ConstructPoint(XCoordinate=pt2num_37, YCoordinate=0, ZCoordinate=0)
line_12 = LineSDL(Start=pt_22, Direction=Vector(0, 0, -1), Length=flatten(division_26))
end_16 = EndPoints(Curve=line_12)  # -> Start, flatten(End)
intcrv_3 = Interpolate(Vertices=end_16.End, Degree=3, Periodic=False, KnotStyle=1)  # -> Curve, Length, Domain
end_17 = EndPoints(Curve=intcrv_3.Curve)  # -> Start, End
pt2num_38 = PointsToNumbers(Points=end_17.Start, Mask=1)
pt2num_39 = PointsToNumbers(Points=end_17.End, Mask=1)
midpt_5 = CurveMiddle(Curve=intcrv_3.Curve)
num2pt_6 = NumbersToPoints(Numbers=pt2num_38, Mask=1)
num2pt_7 = NumbersToPoints(Numbers=pt2num_39, Mask=1)
xz_6 = XZPlane(Origin=midpt_5)
ln_10 = Line(StartPoint=num2pt_6, EndPoint=num2pt_7)
join_13 = JoinCurves(Curves=[intcrv_3.Curve, ln_10], Preserve=False)
T_3 = Text("Ballast Tank Filling")
sift_35 = SiftPattern(List=T_3, SiftPattern=and_2)  # -> Output0, Output1
tag = TextTag3D(Location=xz_6, Text=sift_35.Output1, Size=eval_10, Colour=swatch_4, Justification=2)
preview_19 = CustomPreview(Geometry=[join_13, line_12], Shader=swatch_4)

# ----
sift_36 = SiftPattern(List=[flip_5.Curve, flip_4.Curve], SiftPattern=button_show_cross_sections)  # -> Output0, Output1
sift_37 = SiftPattern(List=boundary_3, SiftPattern=button_show_cross_sections)  # -> Output0, Output1
preview_20 = CustomPreview(Geometry=sift_37.Output1, Material=swatch_5)
preview_21 = CustomPreview(Geometry=sift_36.Output1, Material=swatch_6)

# ----
# Calculation of Am
sort_15 = SortList(Keys=addition_6)  # -> Keys, ValuesA
lng_7 = ListLength(List=sort_15.Keys)  # -> expr("x-1", Length)
item_22 = ListItem(List=sort_15.Keys, Index=lng_7, Wrap=True)

sift_38 = SiftPattern(List=T, SiftPattern=and_2)  # -> Output0, Output1
sift_39 = SiftPattern(List=T_2, SiftPattern=and_2)  # -> Output0, Output1

# ---- group: Curves of Cross sectional areas (continued)
tag_2 = TextTag3D(Location=xz_4, Text=sift_38.Output1, Size=eval_10, Colour=swatch_6, Justification=2)
tag_3 = TextTag3D(Location=xz_5, Text=sift_39.Output1, Size=eval_10, Colour=swatch_5, Justification=2)

# ----
eval_64 = Evaluate(F="round(x/(y^2),3)", x=amoments_2.Area, y=output_dimension)
eval_65 = Evaluate(F="round(x/(y^4),3)", x=amoments_2.Inertia, y=output_dimension)
eval_66 = Evaluate(F="round(x/(y^2),3)", x=item_22, y=output_dimension)
eval_67 = Evaluate(F="round(x/(y^2),3)", x=p_n_c_2, y=output_dimension)
eval_68 = Evaluate(F="round(x/(y^1),3)", x=amoments_2.Centroid, y=output_dimension)
eval_69 = Evaluate(F="round(x/(y^2),3)", x=area_19.Area, y=output_dimension)
panel_35 = Panel("""Water Plane Area 
COF 
Inertia WPA around COF 
Wetted Shell Area 
Wetted Transom Area 
Am """)
merge_10 = Merge(
    Data1=flatten(eval_64),
    Data2=flatten(eval_68),
    Data3=flatten(eval_65),
    Data4=flatten(eval_69),
    Data5=flatten(eval_67),
    Data6=flatten(eval_66))  # -> flatten(Result)
eval_70 = Evaluate(F="round(x,3)", x=merge_10)
rep_10 = ReplaceText(Text=eval_70, Find="{", RecursiveReplace=False)
panel_36 = Panel("""m2
m
m4
m2
m2
m2""")
case_5 = TextCase(Text="Data of underwater areas", Culture=127)  # -> UpperCase, LowerCase
rep_11 = ReplaceText(Text=rep_10, Find="}", RecursiveReplace=False)
rep_12 = ReplaceText(Text=panel_36, Find="m", Replace=eval_14, RecursiveReplace=False)
concat_22 = Concatenate(FragmentB=case_5.UpperCase)
concat_23 = Concatenate(FragmentB=panel_35, FragmentA="[", FragmentC=rep_12, FragmentD="],")
concat_24 = Concatenate(FragmentA=panel_35, FragmentB=rep_11, FragmentC=" ", FragmentD=rep_12)
concat_25 = Concatenate(FragmentA=concat_23, FragmentB=rep_11)
data_waterplane = Panel([case_5.UpperCase, "(Waterplane=blue, shell=white, transom=red)", concat_24])
data_waterplane_2 = Panel([concat_22, concat_25])

# ---- group: Export of Curves of cross sectional areas
eval_71 = Evaluate(F="round(x/(y^2),3)", x=addition_5, y=output_dimension)
eval_72 = Evaluate(F="round(x/(y^1),3)", x=pt2num_30, y=output_dimension)
eval_73 = Evaluate(F="round(x/(y^1),3)", x=pt2num_37, y=output_dimension)
eval_74 = Evaluate(F="round(x/(y^2),3)", x=addition_7, y=output_dimension)
eval_75 = Evaluate(F="\"x_in_\"&dim&\", crossarea_in_\"&dim&\"2\"", dim=eval_14)
eval_76 = Evaluate(F="round(x/(y^2),3)", x=addition_6, y=output_dimension)
eval_77 = Evaluate(F="round(x/(y^1),3)", x=pt2num_31, y=output_dimension)
lng_8 = ListLength(List=eval_77)
concat_26 = Concatenate(FragmentA=eval_73, FragmentC=",", FragmentB=eval_74)
lng_9 = ListLength(List=eval_73)
lng_10 = ListLength(List=eval_72)
concat_27 = Concatenate(FragmentA=eval_72, FragmentC=",", FragmentB=eval_71)
concat_28 = Concatenate(FragmentA=eval_77, FragmentC=",", FragmentB=eval_76)
concat_29 = Concatenate(FragmentA="Number of rows, ", FragmentB=lng_8)  # -> flatten(Result)
case_6 = TextCase(Text="Ballast Tank Filling Cross Section Areas", Culture=127)  # -> UpperCase, LowerCase
case_7 = TextCase(Text="Total Cross Section Areas", Culture=127)  # -> UpperCase, LowerCase
concat_30 = Concatenate(FragmentA="Number of rows, ", FragmentB=lng_9)  # -> flatten(Result)
concat_31 = Concatenate(FragmentA="Number of rows, ", FragmentB=lng_10)  # -> flatten(Result)
case_8 = TextCase(Text="Buoyant Cross Section Areas", Culture=127)  # -> UpperCase, LowerCase
buoyant_cross_section_areas = Panel([case_8.UpperCase, concat_29, eval_75, concat_28])
total_cross_section_areas = Panel([case_7.UpperCase, concat_31, eval_75, concat_27])
ballast_tank_filling_cross_section_areas = Panel([case_6.UpperCase, concat_30, eval_75, concat_26])

# ----
am = Number(item_22)
merge_11 = Merge(
    Data1=flatten(lwl),
    Data2=flatten(B),
    Data3=flatten(t_loading),
    Data4=flatten(displ_moulded),
    Data5=flatten(am),
    Data6=flatten(awp),
    Data7=flatten(cob),
    Data8=flatten(S),
    Data9=flatten(ie),
    Data10=flatten(at),
    Data11=flatten(ta),
    Data12=flatten(tf))  # -> flatten(Result)
filter_5 = StreamFilter(Gate=manual_input, Stream0=merge_11, Stream1=merge)
sift_40 = SiftPattern(List=filter_5, SiftPattern=and_4)  # -> Output0, Output1
nullrep_2 = ReplaceNulls(Items=sift_40.Output1, Replacements=0)  # -> Items, Count
panel_37 = Panel(nullrep_2.Count)
concat_32 = Concatenate(FragmentE="D", FragmentD=panel_30, FragmentA=panel_31, FragmentC=",", FragmentF=" ", FragmentB=nullrep_2.Items)
controle_invoer_waarden = Panel(concat_32)

# ----
# Geschreven op basis van informatie uit de volgende papers:
# Holtrop, J. , & Mennen, G. G. J. (1978). A statistical power prediction method. International Shipbuilding Progress, 25(290). Geraadpleegd van http://resolver.tudelft.nl/uuid:62c40df8-18cc-4225-a65a-54ff5c1609fb
# Holtrop, J., & Mennen, G. G. J. (1982). An approximate power prediction method. International Shipbuilding Progress, ISP, 29(335). Geraadpleegd van http://resolver.tudelft.nl/uuid:ee370fed-4b4f-4a70-af77-e14c3e692fd4
python_2 = GhPythonScript(
    manual=manual_input,
    V_max_kn=maximum_speed_for_resistance_table_kn,
    dt=steps_per_knot_kn,
    S_Selectie=eval,
    Datastream_in=nullrep_2.Items,
    C_Stern=afterbody_form_coefficient_cstern,
    k2=python.k2,
    S_app=python.S_app,
    COB=cob,
    bulb_toggle=bulb,
    A_BT=transverse_oppervlak_bulb_m2,
    h_b=hoogteligging_van_zwaartepunt_transverse,
    boegschroef_toggle=bow_thruster,
    n_boegschroef=nr_of_bow_thrusters,
    C_BTO=resistance_coefficient_bow_thruster,
    d_boegschroef=diameter_bow_thruster_tunnel_m,
    prop_D=diameter_prop_m,
    n_prop=nr_of_props,
    A_T=at,
    i_e_selectie=eval_2,
    deck_check=panel_32)  # -> out, Waarschuwing_paneel, Uitvoer_check, i_e_HMT1984, i_e_HMT1978, S_HMT_benadering, HMT_coefficienten; inputs Datastream_in: list
# ---------- python_2: Python ----------
__author__ = "Jelle Woudstra"
__version__ = "2020.03.25"

import rhinoscriptsyntax as rs
import math
import sys

if manual==False:
    #Importeren van data
    Lwl=Datastream_in[0]/10**3      #Lengte waterlijn
    B=Datastream_in[1]/10**3         #Breedte op waterlijn
    T_a=Datastream_in[10]/10**3     #Diepgang achter
    T_f=Datastream_in[11]/10**3     #Diepgang voor
    T=(T_a+T_f)/2           #Diepgang op 1/2 Lpp
    Displ=Datastream_in[3]/10**9  #Totale waterverplaatsing
    A_m=Datastream_in[4]/10**6    #Oppervlak mainframe
    A_wp=Datastream_in[5]/10**6   #Waterlijn oppervlak
    S=Datastream_in[7]/10**6      #Totaal nat oppervlak romp
    A_t=Datastream_in[9]/10**6    #Transom oppervlak
    A_BT=A_BT/10**6         #Transversaal oppervlak bulb verschalen naar m2
    h_b=h_b                 #Hoogteligging bulb zwaartepunt van mm naar m
    LCB_percentage=100*((COB)-0.5*Lwl)/(Lwl)
    #Berekeningen
    Cm= A_m/(B*T)                #Mainframe coefficient
    Cwp = A_wp/(Lwl*B)          #Waterlijn prismatische coefficient
    Cb= Displ/(Lwl*B*T)         #Blokcoefficient
    Cp=Displ/(A_m*Lwl)          #Prismatische coefficient
    
    
else:
    #Importeren van handmatig ingevoerde data
    Lwl=Datastream_in[0]       #Lengte waterlijn
    B=Datastream_in[1]         #Breedte op waterlijn
    T_a=Datastream_in[2]       #Diepgang achter
    T_f=Datastream_in[3]       #Diepgang voor
    T=(T_a+T_f)/2              #Diepgang op 1/2 Lpp
    Displ=Datastream_in[4]     #Totale waterverplaatsing
    Cm=Datastream_in[5]       #Mainframe coefficient
    A_wp=Datastream_in[6]      #Waterlijn oppervlak
    LCB_percentage=Datastream_in[7] #Lengteligging LCB als % Lwl
    S=Datastream_in[8]         #Totaal nat oppervlak romp
    i_entrance=Datastream_in[9]
    A_t=Datastream_in[10]       #Transom oppervlak
    A_BT=Datastream_in[11]        #Transversaal oppervlak bulb verschalen naar m2
    h_b=Datastream_in[12]
    #Berekeningen
    Cwp = A_wp/(Lwl*B)          #Waterlijn prismatische coefficient
    Cb= Displ/(Lwl*B*T)         #Blokcoefficient
    Cp= Displ/(Lwl*B*T*Cm)      #Prismatische coefficient

#Constanten
g=9.81                       #Zwaartekracht versnelling
rho_zeewater=1025            #Dichtheid van zeewater
water_temp=15                #Temperatuur van water
k_s=150                      #Hull roughness in micrometer
#Kinematische viscositeitscoefficient zeewater bij 15 graden
kin_visc=10**-9*(59046.64-206.7255*(273.14+water_temp)-0.161635*(273.14+water_temp)*rho_zeewater+0.000581097*(273.14+water_temp)**2*rho_zeewater)

S_HMT_benadering=(Lwl*(2*T+B)*math.sqrt(Cm)*(0.453+0.4425*Cb-0.2862*Cm-0.003467*(B/T) + 0.3696*Cwp) +2.38*A_BT/Cb) #Gebruiken voor nat oppervlak benadering volgens HMT

if S_Selectie=="S_wet from Rhino model":
    S=S
elif S_Selectie=="S_Wet HM regressive approach":
    S=S_HMT_benadering

V_max_kn_int=int(V_max_kn)
dt=int(dt)
Waarschuwing_paneel=[]
V_s=[]
V_s_range=[]

#Berekening afbreken check
if (1-Cp-0.0225*LCB_percentage)<0:
    Waarschuwing_paneel.append("Position of LCB too far FWD")
    sys.exit('Position of LCB too far FWD')

for V_s_range in range(6,(V_max_kn_int)*dt-(6*(dt-1)-1)):
    V_s_kn= 6+ (V_s_range-6)*(1/dt)
    V_s=(V_s_kn*(1.852/3.6))                                                 #Berekenen snelheid in m/s
    Fn= V_s/math.sqrt(9.81*Lwl)                                                 #Froude getal
    #Viskeuze weerstand
    if V_s ==0:
        Rn=0
        Cf=0
    else:
        Rn=(V_s*Lwl)/kin_visc                                                   #Reynolds getal
        Cf=(0.075)/(((math.log10(Rn))-2)**2)                                    #Weerstandscoefficient
    R_f=0.5*rho_zeewater*Cf*S*(V_s**2)                                          #Wrijvingsweerstand
    
    if T/Lwl<= 0.02:
        c12=0.479948
    elif T/Lwl<= 0.05:
        c12=48.20*(T/Lwl - 0.02)**2.078 + 0.479948
    else:
        c12=(T/Lwl)**0.2228446
    c13= 1+0.003*C_Stern
    L_R=(1-Cp +(0.06*Cp*LCB_percentage)/(4*Cp-1))*Lwl
    
    #Oude benadering k1=-1 + (c13*(0.93 + (c12*(B/L_R)**0.92497)*((0.95-Cp)**-0.521448)*(1-Cp + 0.0225*LCB_percentage)**0.6906))
    k1=-1 + 0.93+0.487118*(1+0.011*C_Stern)*(B/Lwl)**1.06806*(T/Lwl)**0.46106*(Lwl/L_R)**0.121563*(Lwl**3/Displ)**0.36486*(1-Cp)**-0.604247
    #Appendage weerstand voor MT1458 hoeft dit niet
    """
    Voor de berekening van 1+k2 wordt gerefereerd naar tabel 2 op blz 2 van de paper "An Approximate 
    Power Prediction Method" van J. Holtrop en G.G.J Mennen. Om het programma overzichtelijkheid te 
    behouden is ervoor gekozen om te refereren naar de volgorde van de soorten appendages in de lijst.
    Alles met table1 refereert naar de eerste regel in de tabel; 'rudder behind skeg'. Deze methodiek
    is door de rest van de berekening van k2 gebruikt
    """
    R_app= 0.5*rho_zeewater*(V_s**2)*Cf*S_app*(1+k2)
    S_tot=S+S_app
    
    #Weerstand ten gevolge van boegschroef koker
    if boegschroef_toggle==True:
        R_BTO=rho_zeewater*V_s**2*d_boegschroef**2*math.pi*C_BTO*n_boegschroef
    else:
        R_BTO=0
    
    #Golfmakende weerstand
    c3=(0.56*A_BT**1.5)/(B*T*(0.31*math.sqrt(A_BT)+T_f-h_b))
    c2 =math.exp(-1.89*math.sqrt(c3))
    c5=1-0.8*A_t/(B*T*Cm)
    if B/Lwl<0.11:
        c7=0.229577*(B/Lwl)**0.33333
    elif B/Lwl< 0.25:
        c7=B/Lwl
    else:
        c7=0.5-0.0625*(Lwl/B)
    
    i_e_HMT1984=1+89*math.exp(-(Lwl/B)**0.80856*(1-Cwp)**0.30484*(1-Cp-0.0225*LCB_percentage)**0.6367*(L_R/B)**0.34574*(100*Displ/Lwl**3)**0.16302)
    i_e_HMT1978=125.67*B/Lwl - 162.25*Cp**2 + 234.32*Cp**3 + 0.1551*(LCB_percentage + 6.8*(T_a-T_f)/T)**3
    
    if i_e_selectie== "IE regressive approach 1984":
        i_entrance=i_e_HMT1984 #Benadering voor entreehoek van waterlijn
    if i_e_selectie== "IE regressive approach 1978":
        i_entrance=i_e_HMT1978
    if i_e_selectie== "IE from Rhino model":
        i_entrance=Datastream_in[8]       #Halve entreehoek waterlijn
    if manual==True:
        i_entrance=Datastream_in[9]
    
    
    c1=2223105*(c7**3.78613)*(T/B)**1.07961*(90-i_entrance)**-1.37565
    c17=6919.3*Cm**-1.3346*(Displ/Lwl**3)**2.00977*(Lwl/B-2)**1.40692
    m3=-7.2035*(B/Lwl)**0.326869*(T/B)**0.605375
    d=-0.9
    
    if Lwl/B<12:
        lambda1= 1.446*Cp -0.03*Lwl/B
    else:
        lambda1= 1.446*Cp -0.36
    
    if Cp<0.8:
        c16=8.07981*Cp - 13.8673*Cp**2 + 6.984388*Cp**3
    else:
        c16=1.73014- 0.7067*Cp
    
    if Lwl**3/Displ<512:
        c15=-1.69385
    elif Lwl**3/Displ>512 and Lwl**3/Displ<1727: #Hier is een aanpassing gemaakt
        c15=-1.69385 + (Lwl/(Displ**(1/3))- 8)/2.36
    else:
        c15=0
    m1=0.0140407*(Lwl/T) - (1.75254*Displ**(0.33333))/Lwl -4.79323*B/Lwl -c16
    if Fn==0:
        m2=c15*0.4*(math.exp(-0.034*Fn**-3.29))    #Staat in HMT Excel als m4
    else:
        m2=c15*0.4*(math.exp(-0.034*Fn**-3.29))    #Staat in HMT Excel als m4
    
    if Fn==0:
        R_w=0
    elif Fn<0.4:
        R_w=c1*c2*c5*Displ*rho_zeewater*g*math.exp(m1*Fn**d + m2*math.cos(lambda1*Fn**-2))
    elif 0.4>=Fn<=0.55:
        Rwa=c1*c2*c5*Displ*rho_zeewater*g*math.exp(m1*0.4**d + m2*math.cos(lambda1*0.4**-2))
        Rwb=c1*c2*c5*Displ*rho_zeewater*g*math.exp(m1*0.55**d + m2*math.cos(lambda1*0.55**-2))
        R_w= Rwa+ (10*Fn-4)*(Rwb-Rwa)/1.5
    elif Fn>0.55:
        R_w=c17*c2*c5*Displ*rho_zeewater*g*math.exp(m3*Fn**d + m2*math.cos(lambda1*Fn**-2))
    
    #print(m1)
    
    #Weerstand van bulb
    if bulb_toggle== True:
        Fn_i=V_s/(math.sqrt(g*(T_f-h_b-0.25*math.sqrt(A_BT))+0.15*V_s**2))
        P_b=0.56*math.sqrt(A_BT)/(T_f-1.5*h_b)+0.0000000001
        R_b=(0.11*(math.exp((-3*P_b**-2)))*(Fn_i**3)*(A_BT**1.5)*rho_zeewater*g)/(1+Fn_i**2)
    else:
        R_b=0
    
    #Weerstand van transom area
    if A_t==0:
        R_TR=0
    else:
        Fn_t=V_s/(math.sqrt((2*g*A_t)/(B+B*Cwp)))
        if Fn_t<5:
            c6=0.2*(1-0.2*Fn_t)
        else:
            c6=0
        R_TR= 0.5*rho_zeewater*V_s**2*A_t*c6
    
    #Model-ship correlation resistance: Air resistance
    if T_f/Lwl<=0.04:
        c4=T_f/Lwl
    else:
        c4=0.04
    delta_C_A=(0.105*(k_s/1000000)**0.33333-0.005579)/Lwl**0.33333 #roughness allowance
    C_A=0.006*(Lwl+100)**-0.16 -0.00205 + 0.003*math.sqrt(Lwl/7.5)*Cb**4*c2*(0.04-c4)+delta_C_A
    R_A=0.5*rho_zeewater*V_s**2*S*C_A
    
    #Wake en thrust deduction bepalen
    if n_prop==1: #Formules voor enkel schroef schip
        #Wake factor
        if B/T_a < 5:
            c8=(B*S)/(Lwl*prop_D*T_a)
        elif B/T_a >5:
            c8=S*(7*B/T_a - 25)/(Lwl*prop_D*(B/T_a-3))
        
        if c8<28:
            c9=c8
        elif c8>28:
            c9=32- 16/(c8-24)
        
        if T_a/prop_D<2:
           c11=T_a/prop_D
        elif T_a/prop_D>2:
           c11= 0.083333333*(T_a/prop_D)**3 + 1.3333
        
        if Cp<0.7:
            c19= 0.12997/(0.95-Cb)-0.11056/(0.95-Cp)
        elif Cp>0.7:
            c19=0.18567/(1.3571-Cm) - 0.71276 +0.38648*Cp
        
        c20= 1+0.015*C_Stern
        Cp1=1.45*Cp -0.315 -0.0225*LCB_percentage
        k=(1+k1)+(1+k2-(1+k1))*S_app/S_tot -1
        Cv=(1+k)*Cf +C_A
        w= c9*c20*Cv*(Lwl/T_a)*(0.050776 + 0.93405*c11*(Cv/(1-Cp1))) + 0.27915*c20*math.sqrt(B/(Lwl*(1-Cp1)))+c19*c20
        
        #Thrust Deduction
        t=(0.25014*(B/Lwl)**0.28956*(math.sqrt(B*T)/prop_D)**0.2624)/(1-Cp+0.0225*LCB_percentage)**0.01762+0.0015*C_Stern
    else: 
        #Formules voor meerdere schroeven op schip
        w=0.3095*Cb+10*Cv*Cb - 0.23*prop_D/(math.sqrt(B*T))
        t=0.325*Cb-0.1885*prop_D/(math.sqrt(B*T))
    
    #Totale Weerstand berekenen
    if Fn==0:
        R_total=0
    else:
        R_total=R_f*(1+k1)+ R_w + R_app +R_BTO +R_TR + R_b + R_A 
    if dt==1 or dt==2:
        print(V_s_kn, V_s, Fn, R_total, (R_f*(1+k1)), R_app, R_w, R_TR, R_b, R_A, R_BTO, w, t  )
    else:
        print(V_s_kn, V_s, Fn, R_total, (R_f*(1+k1)), R_app, R_w, R_TR, R_b, R_A, R_BTO, w, t  )
    #    print("%.1f" %V_s_kn,"%.3f" %V_s ,"%.3f" %Fn,"%.0f" %R_total,"%.0f" %(R_f*(1+k1)),"%.0f" %R_app,"%.0f" %R_w,"%.0f" %R_TR,"%.2f" %R_b,"%.2f" %R_A,"%.0f" %R_BTO, "%.4f" %w , "%.4f" %t)
    #else:
    #    print("%.3f" %V_s_kn,"%.3f" %V_s ,"%.3f" %Fn,"%.0f" %R_total,"%.0f" %(R_f*(1+k1)),"%.0f" %R_app,"%.0f" %R_w,"%.0f" %R_TR,"%.2f" %R_b,"%.2f" %R_A,"%.0f" %R_BTO, "%.4f" %w, "%.4f" %t  )

#Check of invoerwaarden voldoen aan beperkingen van het model
if 0.01<= lambda1 <= 1.07:
    pass
else:
    Waarschuwing_paneel.append("Ship does not adhere to 0.01< lambda <1.07 requirement")
if 0.55<= Cp <= 0.85:
    pass
else:
    Waarschuwing_paneel.append("Ship does not adhere to 0.55< Cp < 0.85 requirement")
if 0<= h_b <= 0.6*T_f:
    pass
else:
    Waarschuwing_paneel.append("Ship does not adhere to bulb surface area limitation")
if 1<= i_entrance <=90:
    pass
else:
    Waarschuwing_paneel.append("Ship does not adhere to Half waterline entrance angle limitation")
if -5<= LCB_percentage <=5:
    pass
else:
    Waarschuwing_paneel.append("Ship does not adhere to LCB between -5% and +5%")
if 3.9<= (Lwl/B) <=14.9:
    pass
else:
    Waarschuwing_paneel.append("Ship does not adhere to Lwl/B ratio limitation")
if 2.1<= B/T <=4:
    pass
else:
    Waarschuwing_paneel.append("Ship does not adhere to B/T ratio limitation")
if deck_check=="Deck is submerged":
    Waarschuwing_paneel.append("Deck is submerged, aprroach not valid")
else:
    pass
if n_prop>2:
    Waarschuwing_paneel.append("Twin screw regressive approach used to estimate wake and thrust deduction factor, may not be accurate")
else:
    pass
if Waarschuwing_paneel:
    pass
else:
    Waarschuwing_paneel.append("No Warnings")

#Geselecteerde instellingen
Uitvoer_check=[]
Uitvoer_check.append("Selected step size (dt), %.2f" %(1/dt))
if S_Selectie== "S_wet from Rhino model":
    Uitvoer_check.append("Wetted surface area measured from Rhino model")
if S_Selectie== "S_Wet HM regressive approach":
    Uitvoer_check.append("Wetted surface area calculated with HM approximation")
if i_e_selectie== "IE regressive approach 1984":
    Uitvoer_check.append("Half waterline entrance angle calculated using HMT 1984 method")
if i_e_selectie== "IE regressive approach 1978":
    Uitvoer_check.append("Half waterline entrance angle calculated using HMT 1978 method")
if i_e_selectie== "IE from Rhino model":
    Uitvoer_check.append("Half waterline entrance angle measured from Rhino model")
Uitvoer_check.append("Wake and thrust deduction factor calculated using HMT 1984 method")
Uitvoer_check.append("Number of propellers, %r" %n_prop)
Uitvoer_check.append("Propeller diameter, %r" %prop_D)
Uitvoer_check.append("Chosen stern coefficient, %r" %C_Stern)
if bulb_toggle==True:
    Uitvoer_check.append("Bulb:")
    Uitvoer_check.append("Transverse area:%.3f" %A_BT)
    Uitvoer_check.append("Height bulb:%.3f" %h_b)
else:
    Uitvoer_check.append("No bulb")
if boegschroef_toggle==True:
    if n_boegschroef==1:
        Uitvoer_check.append("Nr of bow or stern thrusters: 1")
    else:
        Uitvoer_check.append("Nr of bowstern thrusters: %r" %n_boegschroef)
    Uitvoer_check.append("Resistance coefficient bow/stern thrusters:%r" %C_BTO)
    Uitvoer_check.append("Diameter bow/stern thrusters:%r" %d_boegschroef)
else:
    Uitvoer_check.append("No bow/stern thrusters")
"""
#Coefficienten uitvoer
HMT_coefficienten=[]
HMT_coefficienten.append("Lwl: %r" %Lwl)
HMT_coefficienten.append("B: %r" %B)
HMT_coefficienten.append("Tapp: %r" %T_a)
HMT_coefficienten.append("Tfpp: %r" %T_f)
HMT_coefficienten.append("Displacement: %r" %Displ)
HMT_coefficienten.append("Cm: %r" %Cm)
HMT_coefficienten.append("Awp: %r" %A_wp)
HMT_coefficienten.append("Cwp: %r" %Cwp)
HMT_coefficienten.append("LCB percentage: %r" %LCB_percentage)
HMT_coefficienten.append("S: %r" %S)
HMT_coefficienten.append("i Entrance: %r" %i_entrance)
HMT_coefficienten.append("A BT: %r" %A_BT)
HMT_coefficienten.append("hb: %r" %h_b)
HMT_coefficienten.append("A transom: %r" %A_t)
HMT_coefficienten.append("C stern: %r" %C_Stern)
HMT_coefficienten.append("Sapp: %r" %S_app)
HMT_coefficienten.append("1+k2: %r" %(1+k2))
HMT_coefficienten.append("Bowthruster diameter: %r" %d_boegschroef)
HMT_coefficienten.append("C BTO: %r" %C_BTO)
HMT_coefficienten.append("Prop D: %r" %prop_D)
HMT_coefficienten.append("Cb: %r" %Cb)
HMT_coefficienten.append("Cp: %r" %Cp)
HMT_coefficienten.append("Cp1: %r" %Cwp)
HMT_coefficienten.append("Lr: %r" %L_R)
HMT_coefficienten.append("1+k1: %r" %(1+k1))
HMT_coefficienten.append("1+k: %r" %(1+k))
HMT_coefficienten.append("S total: %r" %S_tot)
#HMT_coefficienten.append("PB: %r" %P_b)
HMT_coefficienten.append("C A: %r" %C_A)
HMT_coefficienten.append("lambda: %r" %lambda1)
HMT_coefficienten.append("c1: %r" %c1)
HMT_coefficienten.append("c2: %r" %c2)
HMT_coefficienten.append("c3: %r" %c3)
HMT_coefficienten.append("c4: %r" %c4)
HMT_coefficienten.append("c5: %r" %c5)
HMT_coefficienten.append("c7: %r" %c7)
HMT_coefficienten.append("c8: %r" %c8)
HMT_coefficienten.append("c9: %r" %c9)
HMT_coefficienten.append("c11: %r" %c11)
HMT_coefficienten.append("c15: %r" %c15)
HMT_coefficienten.append("c16: %r" %c16)
HMT_coefficienten.append("c17: %r" %c17)
HMT_coefficienten.append("c19: %r" %c19)
HMT_coefficienten.append("c20: %r" %c20)
HMT_coefficienten.append("m1: %r" %m1)
HMT_coefficienten.append("m3: %r" %m3)
"""
# ---------- end python_2 ----------

# ---- group: IE compare
txt = Text("Holtrop84")
txt_2 = Text("Holtrop78")
eval_78 = Evaluate(
    F="Format(\"Deviation of IE_model in % of IE by regressive approach of \"& if(x=2,text1,text2)&\" , {0:0}\" ,if(x=2,(IE_HM78-IE_model)/IE_HM78*100,(IE_HM84-IE_model)/IE_HM84*100))",
    IE_model=nullrep.Items,
    IE_HM84=python_2.i_e_HMT1984,
    IE_HM78=python_2.i_e_HMT1978,
    x=method_selection_half_entrance_angle_ie,
    text1=txt_2,
    text2=txt)

# ---- group: S compare
nullrep_3 = ReplaceNulls(Items=S, Replacements=0)  # -> Items, Count
eval_79 = Evaluate(
    F="Format(\"Deviation of Swet_model in % of S by regressive approach of \"& text2 &\" , {0:0}\",(S_HMT-(Swet_model/1000000))/S_HMT*100)",
    Swet_model=nullrep_3.Items,
    S_HMT=python_2.S_HMT_benadering,
    x=method_selection_wet_shell_area,
    text2=txt)

# ----
ie_hmt_1984 = Panel(python_2.i_e_HMT1984)
ie_hmt1978 = Panel(python_2.i_e_HMT1978)
s_hmt_approach = Panel(python_2.S_HMT_benadering)
rep_13 = ReplaceText(Text=python_2.out, Find="(", RecursiveReplace=False)
lng_11 = ListLength(List=python_2.out)
rep_14 = ReplaceText(Text=rep_13, Find=")", RecursiveReplace=False)
case_9 = TextCase(Text=python_2.Waarschuwing_paneel, Culture=127)  # -> UpperCase, LowerCase
concat_33 = Concatenate(FragmentA="Number of rows, ", FragmentB=lng_11)  # -> flatten(Result)
rep_15 = ReplaceText(Text=rep_14, Find="'", RecursiveReplace=False)
item_23 = ListItem(List=rep_15, Index=eval_62, Wrap=False)
merge_12 = Merge(
    Data1=flatten(case_9.UpperCase),
    Data2=flatten(python_2.Uitvoer_check),
    Data3=flatten(eval_78),
    Data4=flatten(eval_79),
    Data5=flatten(eval_61))
split_10 = TextSplit(Text=item_23, Separators=",")
designspeed_v_kn_v_m_s_fn_rtot_n_r_visc = Panel(item_23)  # "DESIGNSPEED V [kn], V [m/s], Fn, Rtot [N], R_visc [N], R_app [N], R_w [N], R_TR [N], R_b [N], R_A [N], R_BTO [N]"
v_kn_v_m_s_fn_rtot_n_r_visc_n_r_app_n_r = Panel(rep_15)  # "V [kn], V [m/s], Fn, Rtot [N], R_visc [N], R_app [N], R_w [N], R_TR [N], R_b [N], R_A [N], R_BTO [N], w [-], t [-]"
designspeed_v_kn_v_m_s_fn_rtot_n_r_visc_2 = Panel(split_10)  # "DESIGNSPEED V [kn], V [m/s], Fn, Rtot [N], R_visc [N], R_app [N], R_w [N], R_TR [N], R_b [N], R_A [N], R_BTO [N]"
python_3 = GhPythonScript(HMT_toggle=toggle_holtrop_mennen_prediction, Calculation_warning=merge_12, Manual_input=manual_input)  # -> flatten(out), Message_panel; inputs Calculation_warning: list
# ---------- python_3: Python ----------
__author__ = "jlwou"
__version__ = "2021.02.15"

import rhinoscriptsyntax as rs
import math
import sys

Message_panel=[]

if HMT_toggle==False and Manual_input==False:
    print("H&M calculation is turned OFF")
    pass
if HMT_toggle==True and Manual_input==False:
    for k in range(len(Calculation_warning)):
        print(Calculation_warning[k])
    pass
if Manual_input==True:
    print("H&M calculation using manual input")
    for k in range(len(Calculation_warning)):
        print(Calculation_warning[k])
    pass
# ---------- end python_3 ----------
item_24 = ListItem(List=designspeed_v_kn_v_m_s_fn_rtot_n_r_visc_2, Index=0, Wrap=True)  # -> Item, Item1, Item2, Item3
rtot_kn = Number(expr("x/1000", item_24.Item3))
v_kn = Number(item_24.Item)
v_mps = Number(item_24.Item1)
fn = Number(item_24.Item2)
panel_38 = Panel(python_3.out)
panel_39 = Panel(python_2.HMT_coefficienten)
eval_80 = Evaluate(F="Format(\"Rtot {0:0.00} kN at v of {1:0.0} kn\", R,v)", v=v_kn, R=rtot_kn)
panel_40 = Panel(eval_80)
merge_13 = Merge(
    Data1=flatten(panel_33),
    Data2=flatten("DESIGN SPEED DATA"),
    Data3=flatten(panel_34),
    Data4=flatten(designspeed_v_kn_v_m_s_fn_rtot_n_r_visc),
    Data5=flatten("RESISTANCE TABLE BY METHOD HOLTROP & MENNEN 1982 & 1984"),
    Data6=flatten(concat_33),
    Data7=flatten(panel_34),
    Data8=flatten(v_kn_v_m_s_fn_rtot_n_r_visc_n_r_app_n_r),
    Data9=flatten("NOTES & WARNINGS H&M CALCULATION"),
    Data10=flatten(panel_38))

# ---- group: shows IE by regressive approach by HM
eval_81 = Evaluate(F="if(x=2,\"{0:0.00}° by HM78\",\"{0:0.00}° by HM84\")", x=method_selection_half_entrance_angle_ie)
eval_82 = Evaluate(F="if(x=2,y,z)", x=method_selection_half_entrance_angle_ie, y=ie_hmt1978, z=ie_hmt_1984)
rad_4 = Radians(Degrees=eval_82)
xy_8 = XYPlane(Origin=eval_43.Point)
rotate_7 = Rotate(Geometry=line_6, Angle=rad_4, Plane=xy_8)  # -> Geometry, Transform
midpt_6 = CurveMiddle(Curve=rotate_7.Geometry)
angledim_2 = AngularDimension(Center=eval_43.Point, PointA=end_11.End, PointB=midpt_6, Reflex=False, Text=eval_81, Size=expr("x/1.5", eval_10))

# ----
# Curve of Shell Inertia around centroud
sift_41 = SiftPattern(List=flip_4.Curve, SiftPattern=toggle_data_for_longitudinal_bending)  # -> Output0, Output1
sift_42 = SiftPattern(List=pt2num_29, SiftPattern=toggle_data_for_longitudinal_bending)  # -> Output0, Output1
sift_43 = SiftPattern(List=sift_29.Output1, SiftPattern=toggle_data_for_longitudinal_bending)  # -> Output0, Output1
yz_8 = YZPlane(Origin=pt_16)
sec_frames_5 = BrepPlane(Brep=sift_43.Output1, Plane=yz_8)  # -> simplify(Curves), Points
area_23 = Area(Geometry=sec_frames_5.Curves)  # -> Area, Centroid
pt2num_40 = PointsToNumbers(Points=area_23.Centroid, Mask=11)
pt_23 = ConstructPoint(XCoordinate=sift_42.Output1, YCoordinate=0, ZCoordinate=pt2num_40)
sift_44 = SiftPattern(List=sift_27.Output1, SiftPattern=toggle_data_for_longitudinal_bending)  # -> Output0, Output1

data = Data(pt_23)

# ---- group: Data of Inertia wrt longitudinal bending
offset_2 = OffsetCurve(Curve=sift_41.Output1, Distance=eval_8, Plane=PlaneYZ(0, 0, 0), Corners=1)

pshift = ShiftPaths(Data=offset_2, Offset=-1)
len_2 = Length(Curve=sift_41.Output1)
null_9 = NullItem(Item=len_2)  # -> NullFlags, InvalidFlags, Description
p_n_c_6 = PickNChoose(Pattern=null_9.NullFlags, Stream0=len_2, Stream1=0)

merge_14 = Merge(Data1=sift_41.Output1, Data2=pshift)
boundary_6 = BoundarySurfaces(Edges=merge_14)
amoments_3 = AreaMoments(Geometry=boundary_6)  # -> Area, Centroid, Inertia, InertiaError, Secondary, SecondaryError, Gyration
null_10 = NullItem(Item=amoments_3.Area)  # -> NullFlags, InvalidFlags, Description
null_11 = NullItem(Item=amoments_3.Centroid)  # -> NullFlags, InvalidFlags, Description
null_12 = NullItem(Item=amoments_3.Inertia)  # -> NullFlags, InvalidFlags, Description
p_n_c_7 = PickNChoose(Pattern=null_11.NullFlags, Stream0=amoments_3.Centroid, Stream1=data)
p_n_c_8 = PickNChoose(Pattern=null_10.NullFlags, Stream0=amoments_3.Area, Stream1=0)
p_n_c_9 = PickNChoose(Pattern=null_12.NullFlags, Stream0=amoments_3.Inertia, Stream1=Point(0, 0, 0))

box_corners_11 = BoxCorners(Box=boundary_6)  # -> AMinXYZ, CornerB, CornerC, CornerD, CornerE, CornerF, GMaxXYZ, CornerH
pt2num_41 = PointsToNumbers(Points=box_corners_11.GMaxXYZ, Mask=11)
pt2num_42 = PointsToNumbers(Points=box_corners_11.AMinXYZ, Mask=11)
null_13 = NullItem(Item=pt2num_41)  # -> NullFlags, InvalidFlags, Description
null_14 = NullItem(Item=pt2num_42)  # -> NullFlags, InvalidFlags, Description
p_n_c_10 = PickNChoose(Pattern=null_13.NullFlags, Stream0=pt2num_41, Stream1=0)
p_n_c_11 = PickNChoose(Pattern=null_14.NullFlags, Stream0=pt2num_42, Stream1=0)

# ---- group: Z-Centroid of the shell plating
pdecon_22 = Deconstruct(Point=p_n_c_7)  # -> XComponent, YComponent, ZComponent
pt_24 = PointOriented(FramePoints=sift_44.Output1, UComponent=0, VComponent=0, WComponent=0)
pt2num_43 = PointsToNumbers(Points=pt_24, Mask=1)
pt_25 = ConstructPoint(XCoordinate=pt2num_43, YCoordinate=0, ZCoordinate=0)
line_13 = LineSDL(Start=pt_25, Direction=Vector(0, 0, 1), Length=flatten(pdecon_22.ZComponent))
end_18 = EndPoints(Curve=line_13)  # -> Start, flatten(End)
intcrv_4 = Interpolate(Vertices=end_18.End, Degree=3, Periodic=False, KnotStyle=1)  # -> Curve, Length, Domain
end_19 = EndPoints(Curve=intcrv_4.Curve)  # -> Start, End
midpt_7 = CurveMiddle(Curve=intcrv_4.Curve)
pt2num_44 = PointsToNumbers(Points=end_19.Start, Mask=1)
pt2num_45 = PointsToNumbers(Points=end_19.End, Mask=1)
num2pt_8 = NumbersToPoints(Numbers=pt2num_44, Mask=1)
num2pt_9 = NumbersToPoints(Numbers=pt2num_45, Mask=1)
xz_7 = XZPlane(Origin=midpt_7)
ln_11 = Line(StartPoint=num2pt_8, EndPoint=num2pt_9)
join_14 = JoinCurves(Curves=[intcrv_4.Curve, ln_11], Preserve=False)
swatch_7 = ColourSwatch(SwatchColor=RGB(255, 0, 153))
T_4 = Text("Z-Centroid of the shell plating")
preview_22 = CustomPreview(Geometry=join_14, Shader=swatch_7)
tag_4 = TextTag3D(Location=xz_7, Text=T_4, Size=eval_10, Colour=swatch_7, Justification=8)

# ---- group: Curve of Inertia wrt longitudinal bending
panel_41 = Panel("Data of shell plating wrt longitudinal bending (Inertia around centroid):")
eval_83 = Evaluate(F="round(x/(y^2),3)", x=p_n_c_8, y=output_dimension)
eval_84 = Evaluate(F="round(x/(y^4),3)", x=p_n_c_9, y=output_dimension)
eval_85 = Evaluate(F="round(x/(y^1),3)", x=p_n_c_6, y=output_dimension)
eval_86 = Evaluate(F="round(x/(y^1),3)", x=p_n_c_7, y=output_dimension)
eval_87 = Evaluate(F="round(x/(y^1),3)", x=p_n_c_11, y=output_dimension)
eval_88 = Evaluate(F="round(x/(y^1),3)", x=p_n_c_10, y=output_dimension)
pt2num_46 = PointsToNumbers(Points=eval_86, Mask=1)
txt_3 = Text(",")
concat_34 = Concatenate(FragmentA="Mean shell thickness [mm]", FragmentC=",", FragmentB=eval_8)
concat_35 = Concatenate(FragmentA="[", FragmentB=eval_14, FragmentC="]", FragmentD=",")
concat_36 = Concatenate(FragmentA="[", FragmentB=eval_14, FragmentC="2]", FragmentD=",")
case_10 = TextCase(Text=panel_41, Culture=127)  # -> UpperCase, LowerCase
concat_37 = Concatenate(FragmentA="[", FragmentB=eval_14, FragmentC="4]", FragmentD=",")
concat_38 = Concatenate(
    FragmentI=pt2num_46,
    FragmentH=txt_3,
    FragmentA=eval_85,
    FragmentB=txt_3,
    FragmentC=eval_83,
    FragmentD=txt_3,
    FragmentE=eval_86,
    FragmentF=txt_3,
    FragmentG=eval_84,
    FragmentJ=txt_3,
    FragmentK=eval_87,
    FragmentL=txt_3,
    FragmentM=eval_88)
lng_12 = ListLength(List=flatten(pt2num_46))
concat_39 = Concatenate(
    FragmentR="X ",
    FragmentQ=concat_35,
    FragmentO="OUTLINE LENGTH ",
    FragmentP=concat_35,
    FragmentA="CROSS SECTION AREA OF SHELL PLATING ",
    FragmentF=concat_36,
    FragmentC="CENTROID_X",
    FragmentD=concat_35,
    FragmentE="CENTROID_Y",
    FragmentB=concat_35,
    FragmentG="CENTROID_Z",
    FragmentH=concat_35,
    FragmentI="INERTIA_X",
    FragmentJ=concat_37,
    FragmentK="INERTIA_Y",
    FragmentL=concat_37,
    FragmentM="INERTIA_Z",
    FragmentN=concat_37,
    FragmentS="Z_Keel",
    FragmentT=concat_35,
    FragmentU="Z_DECK",
    FragmentV=concat_35)
concat_40 = Concatenate(FragmentA="Number of rows, ", FragmentB=lng_12)  # -> flatten(Result)
rep_16 = ReplaceText(Text=concat_38, Find="{", RecursiveReplace=False)
rep_17 = ReplaceText(Text=rep_16, Find="}", RecursiveReplace=False)
buoyant_cross_section_areas_2 = Panel([case_10.UpperCase, concat_34, concat_40, concat_39, rep_17])

# ---- group: Curve of Inertia around centroid of the shell plating
pdecon_23 = Deconstruct(Point=p_n_c_9)  # -> XComponent, YComponent, ZComponent
scaling = Slider(3.471, range=1..10)
pt_26 = PointOriented(FramePoints=sift_44.Output1, UComponent=0, VComponent=0, WComponent=0)
pt2num_47 = PointsToNumbers(Points=pt_26, Mask=1)
pt_27 = ConstructPoint(XCoordinate=pt2num_47, YCoordinate=0, ZCoordinate=0)
T_5 = Text("Inertia around centroid of the shell plating")
swatch_8 = ColourSwatch(SwatchColor=RGB(0, 255, 81))

# ---- group: Curve of cross section areas of shell plating
division_27 = Division(A=scale_kvs, B=1)
sqr = Square(Value=division_27)
division_28 = Division(A=p_n_c_8, B=sqr)
pt_28 = PointOriented(FramePoints=sift_44.Output1, UComponent=0, VComponent=0, WComponent=0)
pt2num_48 = PointsToNumbers(Points=pt_28, Mask=1)
pt_29 = ConstructPoint(XCoordinate=pt2num_48, YCoordinate=0, ZCoordinate=0)
line_14 = LineSDL(Start=pt_29, Direction=Vector(0, 0, -1), Length=flatten(division_28))
end_20 = EndPoints(Curve=line_14)  # -> Start, flatten(End)
intcrv_5 = Interpolate(Vertices=end_20.End, Degree=3, Periodic=False, KnotStyle=1)  # -> Curve, Length, Domain
end_21 = EndPoints(Curve=intcrv_5.Curve)  # -> Start, End
pt2num_49 = PointsToNumbers(Points=end_21.Start, Mask=1)
pt2num_50 = PointsToNumbers(Points=end_21.End, Mask=1)
num2pt_10 = NumbersToPoints(Numbers=pt2num_49, Mask=1)
num2pt_11 = NumbersToPoints(Numbers=pt2num_50, Mask=1)
ln_12 = Line(StartPoint=num2pt_10, EndPoint=num2pt_11)
join_15 = JoinCurves(Curves=[intcrv_5.Curve, ln_12], Preserve=False)
T_6 = Text("Cross section areas of shell plating")
swatch_9 = ColourSwatch(SwatchColor=RGB(255, 136, 0))
preview_23 = CustomPreview(Geometry=join_15, Shader=swatch_9)

# ----
multiplication_15 = Multiplication(A=scale_kvs, B=scaling)
midpt_8 = CurveMiddle(Curve=intcrv_5.Curve)

# ---- group: Curve of Inertia around centroid of the shell plating (continued)
sqr_2 = Square(Value=multiplication_15)
division_29 = Division(A=pdecon_23.ZComponent, B=sqr_2)
line_15 = LineSDL(Start=pt_27, Direction=Vector(0, 0, -1), Length=flatten(division_29))
end_22 = EndPoints(Curve=line_15)  # -> Start, flatten(End)
intcrv_6 = Interpolate(Vertices=end_22.End, Degree=3, Periodic=False, KnotStyle=1)  # -> Curve, Length, Domain
end_23 = EndPoints(Curve=intcrv_6.Curve)  # -> Start, End
midpt_9 = CurveMiddle(Curve=intcrv_6.Curve)
pt2num_51 = PointsToNumbers(Points=end_23.Start, Mask=1)
pt2num_52 = PointsToNumbers(Points=end_23.End, Mask=1)
num2pt_12 = NumbersToPoints(Numbers=pt2num_51, Mask=1)
num2pt_13 = NumbersToPoints(Numbers=pt2num_52, Mask=1)
xz_8 = XZPlane(Origin=midpt_9)
ln_13 = Line(StartPoint=num2pt_12, EndPoint=num2pt_13)
join_16 = JoinCurves(Curves=[intcrv_6.Curve, ln_13], Preserve=False)
tag_5 = TextTag3D(Location=xz_8, Text=T_5, Size=eval_10, Colour=swatch_8, Justification=2)
preview_24 = CustomPreview(Geometry=[join_16, line_15], Shader=swatch_8)

# ---- group: Curve of cross section areas of shell plating (continued)
xz_9 = XZPlane(Origin=midpt_8)
tag_6 = TextTag3D(Location=xz_9, Text=T_6, Size=eval_10, Colour=swatch_9, Justification=2)

# ---- group: Add values in the resistence graph
split_11 = TextSplit(Text=designspeed_v_kn_v_m_s_fn_rtot_n_r_visc, Separators=",")
z_move_of_values = Slider(2000, range=0..2000)
kd = Diffuse(graft([RGB(0, 0, 0), RGB(0, 128, 128), RGB(255, 128, 0), RGB(255, 0, 0), RGB(192, 192, 0), RGB(0, 128, 0), RGB(0, 0, 255), RGB(0, 0, 192), RGB(192, 0, 192), RGB(192, 192, 192)]))
material = CreateMaterial(Diffuse=kd, Specular=RGB(255, 255, 255), Emission=RGB(0, 0, 0), Transparency=0, Shine=0)
Z_6 = UnitZ(Factor=z_move_of_values)

# ---- group: Creates a resistence graph in Rhino scaled to Lpp and 2H
split_12 = TextSplit(Text=panel_34, Separators=",")
split_13 = TextSplit(Text=rep_15, Separators=",")
x_unit_for_resistance_graph = Slider(0, range=0..2)
eval_89 = Evaluate(F="if(x=0,\"V [knots]\",If(x=1,\"V [m/s]\",\"Froude number [-]\"))", x=x_unit_for_resistance_graph)
panel_42 = Panel(eval_89)
scale_graph_hoa = Slider(2.5, range=1..10)
move_graph_hoa = Slider(1.3, range=1..5)
hoa = Integer(eval_17)
multiplication_16 = Multiplication(A=move_graph_hoa, B=hoa)
Z_7 = UnitZ(Factor=multiplication_16)
kd_2 = Diffuse(graft([RGB(0, 0, 0), RGB(0, 128, 128), RGB(255, 128, 0), RGB(255, 0, 0), RGB(192, 192, 0), RGB(0, 128, 0), RGB(0, 0, 255), RGB(0, 0, 192), RGB(192, 0, 192), RGB(192, 192, 192)]))
material_2 = CreateMaterial(Diffuse=kd_2, Specular=RGB(255, 255, 255), Emission=RGB(0, 0, 0), Transparency=0, Shine=0)

# ----
lng_13 = ListLength(List=split_12)  # -> expr("x-2", Length)
split_14 = SplitList(List=split_11, Index=lng_13)  # -> ListA, ListB
split_15 = SplitList(List=split_13, Index=lng_13)  # -> ListA, ListB
split_16 = SplitList(List=split_12, Index=lng_13)  # -> ListA, ListB

# ---- group: Creates a resistence graph in Rhino scaled to Lpp and 2H (continued)
split_17 = SplitList(List=split_15.ListA, Index=3)  # -> ListA, ListB
split_18 = SplitList(List=split_16.ListA, Index=3)  # -> ListA, graft(ListB)
item_25 = ListItem(List=split_17.ListA, Index=x_unit_for_resistance_graph, Wrap=True)  # -> flatten(Item)
simplify = SimplifyTree(Tree=split_17.ListB, Front=False)
item_26 = ListItem(List=item_25, Index=-1, Wrap=True)
flip_7 = FlipMatrix(Data=simplify)
division_30 = Division(Lpp=filter_lpp1_of_lpp2, B=item_26)
sort_16 = SortList(Keys=flatten(flip_7))  # -> Keys, ValuesA
item_27 = ListItem(List=sort_16.Keys, Index=-1, Wrap=True)
division_31 = Division(A=hoa, B=item_27)
multiplication_17 = Multiplication(A=flip_7, B=division_31, C=scale_graph_hoa)
multiplication_18 = Multiplication(A=item_25, B=division_30)
pt_30 = ConstructPoint(XCoordinate=multiplication_18, YCoordinate=0, ZCoordinate=multiplication_17)
intcrv_7 = Interpolate(Vertices=pt_30, Degree=3, Periodic=False, KnotStyle=1)  # -> simplify(Curve), Length, Domain
move_17 = Move(Geometry=intcrv_7.Curve, Motion=Z_7)  # -> Geometry, Transform
end_24 = EndPoints(Curve=move_17.Geometry)  # -> Start, End
preview_25 = CustomPreview(Geometry=move_17.Geometry, Material=material_2)
tag_7 = TextTag(Location=end_24.End, Text=split_18.ListB, Colour=kd_2)

# ---- group: Add values in the resistence graph (continued)
split_19 = SplitList(List=split_14.ListA, Index=3)  # -> ListA, ListB
item_28 = ListItem(List=split_19.ListA, Index=x_unit_for_resistance_graph, Wrap=True)  # -> flatten(Item)
simplify_2 = SimplifyTree(Tree=split_19.ListB, Front=False)
flip_8 = FlipMatrix(Data=simplify_2)
multiplication_19 = Multiplication(A=flip_8, B=division_31, C=scale_graph_hoa)
multiplication_20 = Multiplication(A=item_28, B=division_30)
pt_31 = ConstructPoint(XCoordinate=multiplication_20, YCoordinate=0, ZCoordinate=multiplication_19)
round = Round(Number=flatten(flip_8))  # -> Nearest, Floor, Ceiling
move_18 = Move(Geometry=pt_31, Motion=Z_7)  # -> Geometry, Transform
move_19 = Move(Geometry=move_18.Geometry, Motion=Z_6)  # -> Geometry, Transform
preview_26 = CustomPreview(Geometry=move_18.Geometry, Material=material)
tag_8 = TextTag(Location=flatten(move_19.Geometry), Text=flatten(round.Nearest), Colour=flatten(kd))

# ---- group: H&M speed setting
equals_6 = Equality(FirstNumber=x_unit_for_resistance_graph, SecondNumber=0)  # -> Equality, Inequality
and_5 = GateAnd(B=equals_6.Equality)
sift_45 = SiftPattern(HMKnots=design_speed_kn, SiftPattern=and_5)  # -> Output0, Output1
multiplication_21 = Multiplication(A=item_28, B=division_30)
multiplication_22 = Multiplication(A=item_27, B=division_31, C=scale_graph_hoa)
pt_32 = ConstructPoint(XCoordinate=multiplication_21, YCoordinate=0, ZCoordinate=0)
pt_33 = ConstructPoint(XCoordinate=multiplication_21, YCoordinate=0, ZCoordinate=multiplication_22)
ln_14 = Line(StartPoint=pt_32, EndPoint=pt_33)
sift_46 = SiftPattern(List=ln_14, SiftPattern=and_5)  # -> Output0, Output1
round_2 = Round(Number=expr("10*x", item_28))  # -> Nearest, Floor, Ceiling
kd_3 = Diffuse(RGB(64, 64, 64))
move_20 = Move(Geometry=sift_46.Output1, Motion=Z_7)  # -> Geometry, Transform
multiplication_23 = Multiplication(A=round_2.Nearest, B=0.1)
material_3 = CreateMaterial(Diffuse=kd_3, Specular=RGB(255, 255, 255), Emission=RGB(0, 0, 0), Transparency=0, Shine=0)
concat_41 = Concatenate(FragmentA=panel_42, FragmentB=" ", FragmentC=multiplication_23)
end_25 = EndPoints(Curve=move_20.Geometry)  # -> Start, End
tag_9 = TextTag(Location=end_25.End, Text=concat_41, Colour=kd_3)
preview_27 = CustomPreview(Geometry=move_20.Geometry, Material=material_3)

# ----
eval_90 = Evaluate(F="round(x/(y^1),3)", x=eval_43.Point, y=output_dimension)
panel_43 = Panel("""Waterline Entrace angle (WEA) 
Location of WEA 
XYZ location of WEA """)
merge_15 = Merge(Data1=flatten(eval_44), Data2=flatten(entrance_angle_factor_of_bwl), Data3=flatten(eval_90))  # -> flatten(Result)
eval_91 = Evaluate(F="round(x,3)", x=merge_15)
panel_44 = Panel("""deg
%Bwl
m""")
rep_18 = ReplaceText(Text=eval_91, Find="{", RecursiveReplace=False)
case_11 = TextCase(Text="Waterline entrance angle:", Culture=127)  # -> UpperCase, LowerCase
rep_19 = ReplaceText(Text=rep_18, Find="}", RecursiveReplace=False)
concat_42 = Concatenate(FragmentB=case_11.UpperCase)

rep_20 = ReplaceText(Text=panel_44, Find="m", Replace=eval_14, RecursiveReplace=False)

concat_43 = Concatenate(FragmentB=panel_43, FragmentA="[", FragmentC=rep_20, FragmentD="],")
concat_44 = Concatenate(FragmentA=panel_43, FragmentB=rep_19, FragmentD=" ", FragmentC=rep_20)
concat_45 = Concatenate(FragmentA=concat_43, FragmentB=rep_19)
waterline_entrance_angle = Panel([concat_42, concat_45])
waterline_entrance_angle_2 = Panel([case_11.UpperCase, concat_44])

merge_16 = Merge(
    Data1=flatten(main_dimensions),
    Data2=flatten(main_dimensions_3),
    Data3=flatten(waterline_entrance_angle),
    Data4=flatten(volume_data),
    Data5=flatten(data_waterplane_2),
    Data6=flatten(volume_data_ballast_water_tank),
    Data7=flatten(buoyant_cross_section_areas),
    Data8=flatten(total_cross_section_areas),
    Data9=flatten(ballast_tank_filling_cross_section_areas),
    Data10=flatten(buoyant_cross_section_areas_2),
    Data11=flatten(input_data),
    Data12=flatten(merge_13))

output_all_data_use_copy_data_only = Panel(merge_16)

# ----
# Help: Set all toggles on true, otherwise some data will be missing. Right mouse click in the output panel below and choose 'Copy Data Only' and paste this in spreadsheet or a text file.
# Use the function Text to Columns in Excel>Tab Data. Use comma (,) as delimiter and a point (.) as decimal qualifier.
output_all_data_use_copy_data_only_2 = Panel(merge_16)
